# Grasshopper definition load_bmc_templates.gh (Grasshopper 1.0.7)

number_slider = Slider(14, range=0..23)
path = FilePath(["C:\Users\sk928\Desktop\thesis\w6_polygonization (1)\w6_polygonization\data\bmc\bmc_templates1\core_00.csv", "C:\Users\sk928\Desktop\thesis\w6_polygonization (1)\w6_polygonization\data\bmc\bmc_templates1\core_01.csv", "C:\Users\sk928\Desktop\thesis\w6_polygonization (1)\w6_polygonization\data\bmc\bmc_templates1\core_02.csv", "C:\Users\sk928\Desktop\thesis\w6_polygonization (1)\w6_polygonization\data\bmc\bmc_templates1\core_03.csv", "C:\Users\sk928\Desktop\thesis\w6_polygonization (1)\w6_polygonization\data\bmc\bmc_templates1\core_04.csv", "C:\Users\sk928\Desktop\thesis\w6_polygonization (1)\w6_polygonization\data\bmc\bmc_templates1\core_05.csv", "C:\Users\sk928\Desktop\thesis\w6_polygonization (1)\w6_polygonization\data\bmc\bmc_templates1\core_06.csv", "C:\Users\sk928\Desktop\thesis\w6_polygonization (1)\w6_polygonization\data\bmc\bmc_templates1\core_07.csv", "C:\Users\sk928\Desktop\thesis\w6_polygonization (1)\w6_polygonization\data\bmc\bmc_templates1\core_08.csv", "C:\Users\sk928\Desktop\thesis\w6_polygonization (1)\w6_polygonization\data\bmc\bmc_templates1\core_09.csv", "C:\Users\sk928\Desktop\thesis\w6_polygonization (1)\w6_polygonization\data\bmc\bmc_templates1\core_10.csv", "C:\Users\sk928\Desktop\thesis\w6_polygonization (1)\w6_polygonization\data\bmc\bmc_templates1\core_11.csv", "C:\Users\sk928\Desktop\thesis\w6_polygonization (1)\w6_polygonization\data\bmc\bmc_templates1\core_12.csv", "C:\Users\sk928\Desktop\thesis\w6_polygonization (1)\w6_polygonization\data\bmc\bmc_templates1\core_13.csv", "C:\Users\sk928\Desktop\thesis\w6_polygonization (1)\w6_polygonization\data\bmc\bmc_templates1\core_14.csv", "C:\Users\sk928\Desktop\thesis\w6_polygonization (1)\w6_polygonization\data\bmc\bmc_templates1\core_15.csv", "C:\Users\sk928\Desktop\thesis\w6_polygonization (1)\w6_polygonization\data\bmc\bmc_templates1\core_16.csv", "C:\Users\sk928\Desktop\thesis\w6_polygonization (1)\w6_polygonization\data\bmc\bmc_templates1\core_17.csv", "C:\Users\sk928\Desktop\thesis\w6_polygonization (1)\w6_polygonization\data\bmc\bmc_templates1\core_18.csv", "C:\Users\sk928\Desktop\thesis\w6_polygonization (1)\w6_polygonization\data\bmc\bmc_templates1\core_19.csv", "C:\Users\sk928\Desktop\thesis\w6_polygonization (1)\w6_polygonization\data\bmc\bmc_templates1\core_20.csv", "C:\Users\sk928\Desktop\thesis\w6_polygonization (1)\w6_polygonization\data\bmc\bmc_templates1\core_21.csv", "C:\Users\sk928\Desktop\thesis\w6_polygonization (1)\w6_polygonization\data\bmc\bmc_templates1\core_22.csv", "C:\Users\sk928\Desktop\thesis\w6_polygonization (1)\w6_polygonization\data\bmc\bmc_templates1\core_23.csv"])
path_2 = FilePath(["C:\Users\sk928\Desktop\thesis\w6_polygonization (1)\w6_polygonization\data\bmc\bmc_templates1\e_neighs_00.csv", "C:\Users\sk928\Desktop\thesis\w6_polygonization (1)\w6_polygonization\data\bmc\bmc_templates1\e_neighs_01.csv", "C:\Users\sk928\Desktop\thesis\w6_polygonization (1)\w6_polygonization\data\bmc\bmc_templates1\e_neighs_02.csv", "C:\Users\sk928\Desktop\thesis\w6_polygonization (1)\w6_polygonization\data\bmc\bmc_templates1\e_neighs_03.csv", "C:\Users\sk928\Desktop\thesis\w6_polygonization (1)\w6_polygonization\data\bmc\bmc_templates1\e_neighs_04.csv", "C:\Users\sk928\Desktop\thesis\w6_polygonization (1)\w6_polygonization\data\bmc\bmc_templates1\e_neighs_05.csv", "C:\Users\sk928\Desktop\thesis\w6_polygonization (1)\w6_polygonization\data\bmc\bmc_templates1\e_neighs_06.csv", "C:\Users\sk928\Desktop\thesis\w6_polygonization (1)\w6_polygonization\data\bmc\bmc_templates1\e_neighs_07.csv", "C:\Users\sk928\Desktop\thesis\w6_polygonization (1)\w6_polygonization\data\bmc\bmc_templates1\e_neighs_08.csv", "C:\Users\sk928\Desktop\thesis\w6_polygonization (1)\w6_polygonization\data\bmc\bmc_templates1\e_neighs_09.csv", "C:\Users\sk928\Desktop\thesis\w6_polygonization (1)\w6_polygonization\data\bmc\bmc_templates1\e_neighs_10.csv", "C:\Users\sk928\Desktop\thesis\w6_polygonization (1)\w6_polygonization\data\bmc\bmc_templates1\e_neighs_11.csv", "C:\Users\sk928\Desktop\thesis\w6_polygonization (1)\w6_polygonization\data\bmc\bmc_templates1\e_neighs_12.csv", "C:\Users\sk928\Desktop\thesis\w6_polygonization (1)\w6_polygonization\data\bmc\bmc_templates1\e_neighs_13.csv", "C:\Users\sk928\Desktop\thesis\w6_polygonization (1)\w6_polygonization\data\bmc\bmc_templates1\e_neighs_14.csv", "C:\Users\sk928\Desktop\thesis\w6_polygonization (1)\w6_polygonization\data\bmc\bmc_templates1\e_neighs_15.csv", "C:\Users\sk928\Desktop\thesis\w6_polygonization (1)\w6_polygonization\data\bmc\bmc_templates1\e_neighs_16.csv", "C:\Users\sk928\Desktop\thesis\w6_polygonization (1)\w6_polygonization\data\bmc\bmc_templates1\e_neighs_17.csv", "C:\Users\sk928\Desktop\thesis\w6_polygonization (1)\w6_polygonization\data\bmc\bmc_templates1\e_neighs_18.csv", "C:\Users\sk928\Desktop\thesis\w6_polygonization (1)\w6_polygonization\data\bmc\bmc_templates1\e_neighs_19.csv", "C:\Users\sk928\Desktop\thesis\w6_polygonization (1)\w6_polygonization\data\bmc\bmc_templates1\e_neighs_20.csv", "C:\Users\sk928\Desktop\thesis\w6_polygonization (1)\w6_polygonization\data\bmc\bmc_templates1\e_neighs_21.csv", "C:\Users\sk928\Desktop\thesis\w6_polygonization (1)\w6_polygonization\data\bmc\bmc_templates1\e_neighs_22.csv", "C:\Users\sk928\Desktop\thesis\w6_polygonization (1)\w6_polygonization\data\bmc\bmc_templates1\e_neighs_23.csv"])
path_3 = FilePath(["C:\Users\sk928\Desktop\thesis\w6_polygonization (1)\w6_polygonization\data\bmc\bmc_templates1\neighs_00.csv", "C:\Users\sk928\Desktop\thesis\w6_polygonization (1)\w6_polygonization\data\bmc\bmc_templates1\neighs_01.csv", "C:\Users\sk928\Desktop\thesis\w6_polygonization (1)\w6_polygonization\data\bmc\bmc_templates1\neighs_02.csv", "C:\Users\sk928\Desktop\thesis\w6_polygonization (1)\w6_polygonization\data\bmc\bmc_templates1\neighs_03.csv", "C:\Users\sk928\Desktop\thesis\w6_polygonization (1)\w6_polygonization\data\bmc\bmc_templates1\neighs_04.csv", "C:\Users\sk928\Desktop\thesis\w6_polygonization (1)\w6_polygonization\data\bmc\bmc_templates1\neighs_05.csv", "C:\Users\sk928\Desktop\thesis\w6_polygonization (1)\w6_polygonization\data\bmc\bmc_templates1\neighs_06.csv", "C:\Users\sk928\Desktop\thesis\w6_polygonization (1)\w6_polygonization\data\bmc\bmc_templates1\neighs_07.csv", "C:\Users\sk928\Desktop\thesis\w6_polygonization (1)\w6_polygonization\data\bmc\bmc_templates1\neighs_08.csv", "C:\Users\sk928\Desktop\thesis\w6_polygonization (1)\w6_polygonization\data\bmc\bmc_templates1\neighs_09.csv", "C:\Users\sk928\Desktop\thesis\w6_polygonization (1)\w6_polygonization\data\bmc\bmc_templates1\neighs_10.csv", "C:\Users\sk928\Desktop\thesis\w6_polygonization (1)\w6_polygonization\data\bmc\bmc_templates1\neighs_11.csv", "C:\Users\sk928\Desktop\thesis\w6_polygonization (1)\w6_polygonization\data\bmc\bmc_templates1\neighs_12.csv", "C:\Users\sk928\Desktop\thesis\w6_polygonization (1)\w6_polygonization\data\bmc\bmc_templates1\neighs_13.csv", "C:\Users\sk928\Desktop\thesis\w6_polygonization (1)\w6_polygonization\data\bmc\bmc_templates1\neighs_14.csv", "C:\Users\sk928\Desktop\thesis\w6_polygonization (1)\w6_polygonization\data\bmc\bmc_templates1\neighs_15.csv", "C:\Users\sk928\Desktop\thesis\w6_polygonization (1)\w6_polygonization\data\bmc\bmc_templates1\neighs_16.csv", "C:\Users\sk928\Desktop\thesis\w6_polygonization (1)\w6_polygonization\data\bmc\bmc_templates1\neighs_17.csv", "C:\Users\sk928\Desktop\thesis\w6_polygonization (1)\w6_polygonization\data\bmc\bmc_templates1\neighs_18.csv", "C:\Users\sk928\Desktop\thesis\w6_polygonization (1)\w6_polygonization\data\bmc\bmc_templates1\neighs_19.csv", "C:\Users\sk928\Desktop\thesis\w6_polygonization (1)\w6_polygonization\data\bmc\bmc_templates1\neighs_20.csv", "C:\Users\sk928\Desktop\thesis\w6_polygonization (1)\w6_polygonization\data\bmc\bmc_templates1\neighs_21.csv", "C:\Users\sk928\Desktop\thesis\w6_polygonization (1)\w6_polygonization\data\bmc\bmc_templates1\neighs_22.csv", "C:\Users\sk928\Desktop\thesis\w6_polygonization (1)\w6_polygonization\data\bmc\bmc_templates1\neighs_23.csv"])
number_slider_2 = Slider(0.191, range=0..1)
number_slider_3 = Slider(1, range=0..1)
load_lattice = GhPythonScript(path=path_2, frame=number_slider)  # -> out, minbound, unit, shape, lattice; inputs path: list, frame: Int32
# ---------- load_lattice: Python ----------
__author__ = "Shervin Azadi"
__license__ = "MIT"
__version__ = "1.0"
__url__ = "https://github.com/shervinazadi/spatial_computing_workshops"
__summary__ = "Loading Lattice CSV"

import Rhino.Geometry as rg
import csv
import ast

def read_csv(path):
    records = []
    minbound,shape,unit = [],[],[]
    with open(path) as csvfile:
        spamreader = csv.reader(csvfile, delimiter=',', quotechar='|')
        for i, row in enumerate(spamreader):
            if 0 < i < 4:
                vals = [ast.literal_eval(item) for item in row]
                minbound.append(vals[0])
                shape.append(vals[1])
                unit.append(vals[2])
            if i > 5:
                records.append([ast.literal_eval(item) for item in row])
    return (records,minbound,shape,unit)
    
# retrieve results
lattice, minbound, shape, unit = read_csv(path[frame])
# ---------- end load_lattice ----------
load_lattice_2 = GhPythonScript(path=path_3, frame=number_slider)  # -> out, minbound, unit, shape, lattice; inputs path: list, frame: Int32; same code as load_lattice
load_lattice_3 = GhPythonScript(path=path, frame=number_slider)  # -> out, minbound, unit, shape, lattice; inputs path: list, frame: Int32; same code as load_lattice
lattice_to_points = GhPythonScript(
    minbound=load_lattice.minbound,
    unit=load_lattice.unit,
    shape=load_lattice.shape,
    lattice=load_lattice.lattice,
    low_bound=number_slider_2,
    high_bound=number_slider_3)  # -> out, points, values; inputs minbound: list, unit: list, shape: list, lattice: list
# ---------- lattice_to_points: Python ----------
__author__ = "Shervin Azadi"
__license__ = "MIT"
__version__ = "1.0"
__url__ = "https://github.com/shervinazadi/spatial_computing_workshops"
__summary__ = "Visualize Lattice CSV"

import Rhino.Geometry as rg

points = []
values = []
for row in lattice:
    if  low_bound <= row[3] <= high_bound:
        point = rg.Point3d(row[0]*unit[0] + minbound[0], row[1]*unit[1] + minbound[1], row[2]*unit[2] + minbound[2])
        points.append(point)
        values.append(row[3])
# ---------- end lattice_to_points ----------
lattice_to_points_2 = GhPythonScript(
    minbound=load_lattice_2.minbound,
    unit=load_lattice_2.unit,
    shape=load_lattice_2.shape,
    lattice=load_lattice_2.lattice,
    low_bound=number_slider_2,
    high_bound=number_slider_3)  # -> out, points, values; inputs minbound: list, unit: list, shape: list, lattice: list; same code as lattice_to_points
lattice_to_points_3 = GhPythonScript(
    minbound=load_lattice_3.minbound,
    unit=load_lattice_3.unit,
    shape=load_lattice_3.shape,
    lattice=load_lattice_3.lattice,
    low_bound=number_slider_2,
    high_bound=number_slider_3)  # -> out, points, values; inputs minbound: list, unit: list, shape: list, lattice: list; same code as lattice_to_points
box = CenterBox(Base=lattice_to_points_3.points, X=0.5, Y=0.5, Z=0.5)
debrep = DeconstructBrep(Brep=box)  # -> Faces, Edges, Vertices
box_2 = CenterBox(Base=lattice_to_points_2.points, X=0.5, Y=0.5, Z=0.5)
box_3 = CenterBox(Base=lattice_to_points.points, X=0.5, Y=0.5, Z=0.5)
preview = CustomPreview(Geometry=box_2, Material=ColourSwatch(SwatchColor=RGBA(42, 127, 98, 145)))
preview_2 = CustomPreview(Geometry=[box, debrep.Edges], Material=ColourSwatch(SwatchColor=RGB(201, 112, 100)))
preview_3 = CustomPreview(Geometry=box_3, Material=ColourSwatch(SwatchColor=RGBA(153, 255, 204, 144)))
