# Grasshopper definition load_lattice_csv.gh (Grasshopper 1.0.7)

path = FilePath("C:\Users\sk928\Desktop\thesis\w1\w1\data\sun_access.csv")
load_lattice = GhPythonScript(path=path, frame=Slider(0, range=0..4))  # -> out, minbound, unit, shape, lattice; inputs path: list, frame: Int32
# ---------- load_lattice: Python ----------
__author__ = "Shervin Azadi"
__license__ = "MIT"
__version__ = "1.0"
__url__ = "https://github.com/shervinazadi/spatial_computing_workshops"
__summary__ = "Loading Lattice CSV"

import Rhino.Geometry as rg
import csv
import ast

def read_csv(path):
    records = []
    minbound,shape,unit = [],[],[]
    with open(path) as csvfile:
        spamreader = csv.reader(csvfile, delimiter=',', quotechar='|')
        for i, row in enumerate(spamreader):
            if 0 < i < 4:
                vals = [ast.literal_eval(item) for item in row]
                minbound.append(vals[0])
                shape.append(vals[1])
                unit.append(vals[2])
            if i > 5:
                records.append([ast.literal_eval(item) for item in row])
    return (records,minbound,shape,unit)
    
# retrieve results
lattice, minbound, shape, unit = read_csv(path[frame])
# ---------- end load_lattice ----------
lattice_to_points = GhPythonScript(
    minbound=load_lattice.minbound,
    unit=load_lattice.unit,
    shape=load_lattice.shape,
    lattice=load_lattice.lattice,
    low_bound=Slider(0.07, range=0..1),
    high_bound=Slider(0.984, range=0..1))  # -> out, points, values; inputs minbound: list, unit: list, shape: list, lattice: list
# ---------- lattice_to_points: Python ----------
__author__ = "Shervin Azadi"
__license__ = "MIT"
__version__ = "1.0"
__url__ = "https://github.com/shervinazadi/spatial_computing_workshops"
__summary__ = "Visualize Lattice CSV"

import Rhino.Geometry as rg

points = []
values = []
for row in lattice:
    if  low_bound <= row[3] <= high_bound:
        point = rg.Point3d(row[0]*unit[0] + minbound[0], row[1]*unit[1] + minbound[1], row[2]*unit[2] + minbound[2])
        points.append(point)
        values.append(row[3])
# ---------- end lattice_to_points ----------
number_slider = Slider(100, range=0..100)
number_slider_2 = Slider(16, range=0..23)
number_slider_3 = Slider(4, range=0..10)
number_slider_4 = Slider(10, range=0..10)
panel = Panel(lattice_to_points.values)
box = CenterBox(Base=lattice_to_points.points, X=number_slider_3, Y=number_slider_3, Z=number_slider_3)
preview = CustomPreview(Geometry=box, Material=ColourSwatch(SwatchColor=RGB(187, 206, 255)))
scale = Scale(Geometry=box, Center=Point(0, 0, 0), Factor=Slider(12, range=0..100))  # -> Geometry, Transform
path_2 = FilePath(["C:\Users\sk928\Downloads\w6_polygonization (1)\w6_polygonization\data\bmc\bmc_templates\core_00.csv", "C:\Users\sk928\Downloads\w6_polygonization (1)\w6_polygonization\data\bmc\bmc_templates\core_01.csv", "C:\Users\sk928\Downloads\w6_polygonization (1)\w6_polygonization\data\bmc\bmc_templates\core_02.csv", "C:\Users\sk928\Downloads\w6_polygonization (1)\w6_polygonization\data\bmc\bmc_templates\core_03.csv", "C:\Users\sk928\Downloads\w6_polygonization (1)\w6_polygonization\data\bmc\bmc_templates\core_04.csv", "C:\Users\sk928\Downloads\w6_polygonization (1)\w6_polygonization\data\bmc\bmc_templates\core_05.csv", "C:\Users\sk928\Downloads\w6_polygonization (1)\w6_polygonization\data\bmc\bmc_templates\core_06.csv", "C:\Users\sk928\Downloads\w6_polygonization (1)\w6_polygonization\data\bmc\bmc_templates\core_07.csv", "C:\Users\sk928\Downloads\w6_polygonization (1)\w6_polygonization\data\bmc\bmc_templates\core_08.csv", "C:\Users\sk928\Downloads\w6_polygonization (1)\w6_polygonization\data\bmc\bmc_templates\core_09.csv", "C:\Users\sk928\Downloads\w6_polygonization (1)\w6_polygonization\data\bmc\bmc_templates\core_10.csv", "C:\Users\sk928\Downloads\w6_polygonization (1)\w6_polygonization\data\bmc\bmc_templates\core_11.csv", "C:\Users\sk928\Downloads\w6_polygonization (1)\w6_polygonization\data\bmc\bmc_templates\core_12.csv", "C:\Users\sk928\Downloads\w6_polygonization (1)\w6_polygonization\data\bmc\bmc_templates\core_13.csv", "C:\Users\sk928\Downloads\w6_polygonization (1)\w6_polygonization\data\bmc\bmc_templates\core_14.csv", "C:\Users\sk928\Downloads\w6_polygonization (1)\w6_polygonization\data\bmc\bmc_templates\core_15.csv", "C:\Users\sk928\Downloads\w6_polygonization (1)\w6_polygonization\data\bmc\bmc_templates\core_16.csv", "C:\Users\sk928\Downloads\w6_polygonization (1)\w6_polygonization\data\bmc\bmc_templates\core_17.csv", "C:\Users\sk928\Downloads\w6_polygonization (1)\w6_polygonization\data\bmc\bmc_templates\core_18.csv", "C:\Users\sk928\Downloads\w6_polygonization (1)\w6_polygonization\data\bmc\bmc_templates\core_19.csv", "C:\Users\sk928\Downloads\w6_polygonization (1)\w6_polygonization\data\bmc\bmc_templates\core_20.csv", "C:\Users\sk928\Downloads\w6_polygonization (1)\w6_polygonization\data\bmc\bmc_templates\core_21.csv", "C:\Users\sk928\Downloads\w6_polygonization (1)\w6_polygonization\data\bmc\bmc_templates\core_22.csv", "C:\Users\sk928\Downloads\w6_polygonization (1)\w6_polygonization\data\bmc\bmc_templates\core_23.csv"])
path_3 = FilePath(["C:\Users\sk928\Downloads\w6_polygonization (1)\w6_polygonization\data\bmc\bmc_templates\neighs_00.csv", "C:\Users\sk928\Downloads\w6_polygonization (1)\w6_polygonization\data\bmc\bmc_templates\neighs_01.csv", "C:\Users\sk928\Downloads\w6_polygonization (1)\w6_polygonization\data\bmc\bmc_templates\neighs_02.csv", "C:\Users\sk928\Downloads\w6_polygonization (1)\w6_polygonization\data\bmc\bmc_templates\neighs_03.csv", "C:\Users\sk928\Downloads\w6_polygonization (1)\w6_polygonization\data\bmc\bmc_templates\neighs_04.csv", "C:\Users\sk928\Downloads\w6_polygonization (1)\w6_polygonization\data\bmc\bmc_templates\neighs_05.csv", "C:\Users\sk928\Downloads\w6_polygonization (1)\w6_polygonization\data\bmc\bmc_templates\neighs_06.csv", "C:\Users\sk928\Downloads\w6_polygonization (1)\w6_polygonization\data\bmc\bmc_templates\neighs_07.csv", "C:\Users\sk928\Downloads\w6_polygonization (1)\w6_polygonization\data\bmc\bmc_templates\neighs_08.csv", "C:\Users\sk928\Downloads\w6_polygonization (1)\w6_polygonization\data\bmc\bmc_templates\neighs_09.csv", "C:\Users\sk928\Downloads\w6_polygonization (1)\w6_polygonization\data\bmc\bmc_templates\neighs_10.csv", "C:\Users\sk928\Downloads\w6_polygonization (1)\w6_polygonization\data\bmc\bmc_templates\neighs_11.csv", "C:\Users\sk928\Downloads\w6_polygonization (1)\w6_polygonization\data\bmc\bmc_templates\neighs_12.csv", "C:\Users\sk928\Downloads\w6_polygonization (1)\w6_polygonization\data\bmc\bmc_templates\neighs_13.csv", "C:\Users\sk928\Downloads\w6_polygonization (1)\w6_polygonization\data\bmc\bmc_templates\neighs_14.csv", "C:\Users\sk928\Downloads\w6_polygonization (1)\w6_polygonization\data\bmc\bmc_templates\neighs_15.csv", "C:\Users\sk928\Downloads\w6_polygonization (1)\w6_polygonization\data\bmc\bmc_templates\neighs_16.csv", "C:\Users\sk928\Downloads\w6_polygonization (1)\w6_polygonization\data\bmc\bmc_templates\neighs_17.csv", "C:\Users\sk928\Downloads\w6_polygonization (1)\w6_polygonization\data\bmc\bmc_templates\neighs_18.csv", "C:\Users\sk928\Downloads\w6_polygonization (1)\w6_polygonization\data\bmc\bmc_templates\neighs_19.csv", "C:\Users\sk928\Downloads\w6_polygonization (1)\w6_polygonization\data\bmc\bmc_templates\neighs_20.csv", "C:\Users\sk928\Downloads\w6_polygonization (1)\w6_polygonization\data\bmc\bmc_templates\neighs_21.csv", "C:\Users\sk928\Downloads\w6_polygonization (1)\w6_polygonization\data\bmc\bmc_templates\neighs_22.csv", "C:\Users\sk928\Downloads\w6_polygonization (1)\w6_polygonization\data\bmc\bmc_templates\neighs_23.csv"])
path_4 = FilePath(["C:\Users\sk928\Downloads\w6_polygonization (1)\w6_polygonization\data\bmc\bmc_templates\e_neighs_00.csv", "C:\Users\sk928\Downloads\w6_polygonization (1)\w6_polygonization\data\bmc\bmc_templates\e_neighs_01.csv", "C:\Users\sk928\Downloads\w6_polygonization (1)\w6_polygonization\data\bmc\bmc_templates\e_neighs_02.csv", "C:\Users\sk928\Downloads\w6_polygonization (1)\w6_polygonization\data\bmc\bmc_templates\e_neighs_03.csv", "C:\Users\sk928\Downloads\w6_polygonization (1)\w6_polygonization\data\bmc\bmc_templates\e_neighs_04.csv", "C:\Users\sk928\Downloads\w6_polygonization (1)\w6_polygonization\data\bmc\bmc_templates\e_neighs_05.csv", "C:\Users\sk928\Downloads\w6_polygonization (1)\w6_polygonization\data\bmc\bmc_templates\e_neighs_06.csv", "C:\Users\sk928\Downloads\w6_polygonization (1)\w6_polygonization\data\bmc\bmc_templates\e_neighs_07.csv", "C:\Users\sk928\Downloads\w6_polygonization (1)\w6_polygonization\data\bmc\bmc_templates\e_neighs_08.csv", "C:\Users\sk928\Downloads\w6_polygonization (1)\w6_polygonization\data\bmc\bmc_templates\e_neighs_09.csv", "C:\Users\sk928\Downloads\w6_polygonization (1)\w6_polygonization\data\bmc\bmc_templates\e_neighs_10.csv", "C:\Users\sk928\Downloads\w6_polygonization (1)\w6_polygonization\data\bmc\bmc_templates\e_neighs_11.csv", "C:\Users\sk928\Downloads\w6_polygonization (1)\w6_polygonization\data\bmc\bmc_templates\e_neighs_12.csv", "C:\Users\sk928\Downloads\w6_polygonization (1)\w6_polygonization\data\bmc\bmc_templates\e_neighs_13.csv", "C:\Users\sk928\Downloads\w6_polygonization (1)\w6_polygonization\data\bmc\bmc_templates\e_neighs_14.csv", "C:\Users\sk928\Downloads\w6_polygonization (1)\w6_polygonization\data\bmc\bmc_templates\e_neighs_15.csv", "C:\Users\sk928\Downloads\w6_polygonization (1)\w6_polygonization\data\bmc\bmc_templates\e_neighs_16.csv", "C:\Users\sk928\Downloads\w6_polygonization (1)\w6_polygonization\data\bmc\bmc_templates\e_neighs_17.csv", "C:\Users\sk928\Downloads\w6_polygonization (1)\w6_polygonization\data\bmc\bmc_templates\e_neighs_18.csv", "C:\Users\sk928\Downloads\w6_polygonization (1)\w6_polygonization\data\bmc\bmc_templates\e_neighs_19.csv", "C:\Users\sk928\Downloads\w6_polygonization (1)\w6_polygonization\data\bmc\bmc_templates\e_neighs_20.csv", "C:\Users\sk928\Downloads\w6_polygonization (1)\w6_polygonization\data\bmc\bmc_templates\e_neighs_21.csv", "C:\Users\sk928\Downloads\w6_polygonization (1)\w6_polygonization\data\bmc\bmc_templates\e_neighs_22.csv", "C:\Users\sk928\Downloads\w6_polygonization (1)\w6_polygonization\data\bmc\bmc_templates\e_neighs_23.csv"])
number_slider_5 = Slider(0.117, range=0..1)
number_slider_6 = Slider(1, range=0..1)
load_lattice_2 = GhPythonScript(path=path_4, frame=number_slider_2)  # -> out, minbound, unit, shape, lattice; inputs path: list, frame: Int32; same code as load_lattice
load_lattice_3 = GhPythonScript(path=path_3, frame=number_slider_2)  # -> out, minbound, unit, shape, lattice; inputs path: list, frame: Int32; same code as load_lattice
load_lattice_4 = GhPythonScript(path=path_2, frame=number_slider_2)  # -> out, minbound, unit, shape, lattice; inputs path: list, frame: Int32; same code as load_lattice
panel_2 = Panel(path_2)
lattice_to_points_2 = GhPythonScript(
    minbound=load_lattice_2.minbound,
    unit=load_lattice_2.unit,
    shape=load_lattice_2.shape,
    lattice=load_lattice_2.lattice,
    low_bound=number_slider_5,
    high_bound=number_slider_6)  # -> out, points, values; inputs minbound: list, unit: list, shape: list, lattice: list; same code as lattice_to_points
lattice_to_points_3 = GhPythonScript(
    minbound=load_lattice_3.minbound,
    unit=load_lattice_3.unit,
    shape=load_lattice_3.shape,
    lattice=load_lattice_3.lattice,
    low_bound=number_slider_5,
    high_bound=number_slider_6)  # -> out, points, values; inputs minbound: list, unit: list, shape: list, lattice: list; same code as lattice_to_points
lattice_to_points_4 = GhPythonScript(
    minbound=load_lattice_4.minbound,
    unit=load_lattice_4.unit,
    shape=load_lattice_4.shape,
    lattice=load_lattice_4.lattice,
    low_bound=number_slider_5,
    high_bound=number_slider_6)  # -> out, points, values; inputs minbound: list, unit: list, shape: list, lattice: list; same code as lattice_to_points
box_2 = CenterBox(Base=lattice_to_points_2.points, X=0.5, Y=0.5, Z=0.5)
box_3 = CenterBox(Base=lattice_to_points_3.points, X=0.5, Y=0.5, Z=0.5)
box_4 = CenterBox(Base=lattice_to_points_4.points, X=0.5, Y=0.5, Z=0.5)
col = Colour(RGBA(102, 0, 255, 126))
col_2 = Colour(RGBA(0, 183, 255, 102))
col_3 = Colour(RGBA(255, 255, 255, 129))
preview_2 = CustomPreview(Geometry=box_3, Material=col)
preview_3 = CustomPreview(Geometry=box_2, Material=col_2)
preview_4 = CustomPreview(Geometry=box_4, Material=col_3)
