# Grasshopper definition tileset_configuring.gh (Grasshopper 1.0.7)

python = GhPythonScript(R=Slider(0.018, range=0..0.1), T=Slider(0.024, range=0..0.1))  # -> out, a, opt_floorheight, num_stairs, Angle
# ---------- python: Python ----------
import math as math


print(R/T)
Riser = (2*R)
opt_riser = (Riser + T)
opt_floorheight = opt_riser * 5d

num_stairs = math.ceil(opt_floorheight / R)
 
print(opt_riser)

Angle = (T/R) *(math.pi/180)
print (Angle)
# ---------- end python ----------
panel = Panel(python.opt_floorheight)
# Tileset number
panel_2 = Panel(python.Angle)
panel_3 = Panel(python.num_stairs)
brep = Brep([<brep referenced from the Rhino model> x3])
area = Area(Geometry=brep)  # -> Area, Centroid
line = LineSDL(Start=area.Centroid, Direction=Vector(0, 0, 1), Length=1)
rotax = RotateAxis(Geometry=brep, Angle=degrees(Slider(90, range=0..100)), Axis=line)  # -> Geometry, Transform
vec = VectorXYZ(XComponent=Slider(-6, range=-10..1), YComponent=Slider(-3, range=-10..1), ZComponent=0)  # -> Vector, Length
pt = ConstructPoint(XCoordinate="0", YCoordinate=Slider(7, range=0..100), ZCoordinate="0")
move = Move(Geometry=rotax.Geometry, Motion=vec.Vector)  # -> Geometry, Transform
X = UnitX(Factor="2")
arrlinear = LinearArray(Geometry=pt, Direction=X, Count=Slider(23, range=0..100))  # -> Geometry, Transform
number_slider = Slider(3, range=0..15)

# ----
# Facade tileset
file_path = FilePath(["C:\Users\sk928\Documents\GitHub\Thesis-modular-facade\data\bmc\bmc_newtemplates\core_00.csv", "C:\Users\sk928\Documents\GitHub\Thesis-modular-facade\data\bmc\bmc_newtemplates\core_01.csv", "C:\Users\sk928\Documents\GitHub\Thesis-modular-facade\data\bmc\bmc_newtemplates\core_02.csv", "C:\Users\sk928\Documents\GitHub\Thesis-modular-facade\data\bmc\bmc_newtemplates\core_03.csv", "C:\Users\sk928\Documents\GitHub\Thesis-modular-facade\data\bmc\bmc_newtemplates\core_04.csv", "C:\Users\sk928\Documents\GitHub\Thesis-modular-facade\data\bmc\bmc_newtemplates\core_05.csv", "C:\Users\sk928\Documents\GitHub\Thesis-modular-facade\data\bmc\bmc_newtemplates\core_06.csv", "C:\Users\sk928\Documents\GitHub\Thesis-modular-facade\data\bmc\bmc_newtemplates\core_07.csv", "C:\Users\sk928\Documents\GitHub\Thesis-modular-facade\data\bmc\bmc_newtemplates\core_08.csv", "C:\Users\sk928\Documents\GitHub\Thesis-modular-facade\data\bmc\bmc_newtemplates\core_09.csv", "C:\Users\sk928\Documents\GitHub\Thesis-modular-facade\data\bmc\bmc_newtemplates\core_10.csv", "C:\Users\sk928\Documents\GitHub\Thesis-modular-facade\data\bmc\bmc_newtemplates\core_11.csv", "C:\Users\sk928\Documents\GitHub\Thesis-modular-facade\data\bmc\bmc_newtemplates\core_12.csv", "C:\Users\sk928\Documents\GitHub\Thesis-modular-facade\data\bmc\bmc_newtemplates\core_13.csv", "C:\Users\sk928\Documents\GitHub\Thesis-modular-facade\data\bmc\bmc_newtemplates\core_14.csv", "C:\Users\sk928\Documents\GitHub\Thesis-modular-facade\data\bmc\bmc_newtemplates\core_15.csv"])
python_script = PythonScript(x=file_path)  # -> out, a, b
# ---------- python_script: Python ----------
import Rhino.Geometry as rg
file = open(x)
lines = file.readlines()
pts=[]
faces=[]
for line in lines:
    if line.find("v")==0 and line.find("n")==-1 and line.find("t")==-1:
        print line.split(' ')
        pts.Add(rg.Point3d(float((line.split(' '))[1]),float((line.split(' '))[2]),float((line.split(' '))[3])))
    if line.find("f")==0:
        if line.split(' ').Count==4:
            faces.Add(rg.MeshFace(int(line.split(' ')[1].split('/')[0])-1,int(line.split(' ')[2].split('/')[0])-1,int(line.split(' ')[3].split('/')[0])-1))
        if line.split(' ').Count==5:
            faces.Add(rg.MeshFace(int(line.split(' ')[1].split('/')[0])-1,int(line.split(' ')[2].split('/')[0])-1,int(line.split(' ')[3].split('/')[0])-1,int(line.split(' ')[4].split('/')[0])-1))
a=pts
b=faces
# ---------- end python_script ----------
panel_4 = Panel(file_path)
construct_mesh = ConstructMesh(Vertices=python_script.a, Faces=python_script.b)  # -> graft(Mesh)
flatten = FlattenTree(Tree=construct_mesh, Path="{0}")
item = ListItem(List=simplify(flatten), Index=number_slider, Wrap=True)

# ----
# structural  tileset
file_path_2 = FilePath(["C:\Users\sk928\Desktop\thesis\w6_polygonization (1)\w6_polygonization\data\bmc\facade_tile copy\t_00.obj", "C:\Users\sk928\Desktop\thesis\w6_polygonization (1)\w6_polygonization\data\bmc\facade_tile copy\t_01.obj", "C:\Users\sk928\Desktop\thesis\w6_polygonization (1)\w6_polygonization\data\bmc\facade_tile copy\t_02.obj", "C:\Users\sk928\Desktop\thesis\w6_polygonization (1)\w6_polygonization\data\bmc\facade_tile copy\t_03.obj", "C:\Users\sk928\Desktop\thesis\w6_polygonization (1)\w6_polygonization\data\bmc\facade_tile copy\t_04.obj", "C:\Users\sk928\Desktop\thesis\w6_polygonization (1)\w6_polygonization\data\bmc\facade_tile copy\t_05.obj", "C:\Users\sk928\Desktop\thesis\w6_polygonization (1)\w6_polygonization\data\bmc\facade_tile copy\t_06.obj", "C:\Users\sk928\Desktop\thesis\w6_polygonization (1)\w6_polygonization\data\bmc\facade_tile copy\t_07.obj", "C:\Users\sk928\Desktop\thesis\w6_polygonization (1)\w6_polygonization\data\bmc\facade_tile copy\t_08.obj", "C:\Users\sk928\Desktop\thesis\w6_polygonization (1)\w6_polygonization\data\bmc\facade_tile copy\t_09.obj", "C:\Users\sk928\Desktop\thesis\w6_polygonization (1)\w6_polygonization\data\bmc\facade_tile copy\t_10.obj", "C:\Users\sk928\Desktop\thesis\w6_polygonization (1)\w6_polygonization\data\bmc\facade_tile copy\t_11.obj", "C:\Users\sk928\Desktop\thesis\w6_polygonization (1)\w6_polygonization\data\bmc\facade_tile copy\t_12.obj", "C:\Users\sk928\Desktop\thesis\w6_polygonization (1)\w6_polygonization\data\bmc\facade_tile copy\t_13.obj", "C:\Users\sk928\Desktop\thesis\w6_polygonization (1)\w6_polygonization\data\bmc\facade_tile copy\t_14.obj", "C:\Users\sk928\Desktop\thesis\w6_polygonization (1)\w6_polygonization\data\bmc\facade_tile copy\t_15.obj", "C:\Users\sk928\Desktop\thesis\w6_polygonization (1)\w6_polygonization\data\bmc\facade_tile copy\t_16.obj", "C:\Users\sk928\Desktop\thesis\w6_polygonization (1)\w6_polygonization\data\bmc\facade_tile copy\t_17.obj", "C:\Users\sk928\Desktop\thesis\w6_polygonization (1)\w6_polygonization\data\bmc\facade_tile copy\t_18.obj", "C:\Users\sk928\Desktop\thesis\w6_polygonization (1)\w6_polygonization\data\bmc\facade_tile copy\t_19.obj", "C:\Users\sk928\Desktop\thesis\w6_polygonization (1)\w6_polygonization\data\bmc\facade_tile copy\t_20.obj", "C:\Users\sk928\Desktop\thesis\w6_polygonization (1)\w6_polygonization\data\bmc\facade_tile copy\t_21.obj", "C:\Users\sk928\Desktop\thesis\w6_polygonization (1)\w6_polygonization\data\bmc\facade_tile copy\t_22.obj", "C:\Users\sk928\Desktop\thesis\w6_polygonization (1)\w6_polygonization\data\bmc\facade_tile copy\t_23.obj"])
python_script_2 = PythonScript(x=file_path_2)  # -> out, a, b; same code as python_script
panel_5 = Panel(file_path_2)
construct_mesh_2 = ConstructMesh(Vertices=python_script_2.a, Faces=python_script_2.b)  # -> graft(Mesh)
flatten_2 = FlattenTree(Tree=construct_mesh_2, Path="{0}")
item_2 = ListItem(List=simplify(flatten_2), Index=number_slider, Wrap=True)
python_2 = GhPythonScript(x=number_slider, y=item_2)  # -> out, a
# ---------- python_2: Python ----------
__author__ = "sk928"
__version__ = "2022.01.11"

import rhinoscriptsyntax as rs
import Rhino as rc

x= int(x)
print x
translation = rs.VectorCreate((0,0,0), (0,0,1)) 
translationo = rs.VectorCreate((0,0,0), (0,0,0))

if ((x == 3)or(x == 6)or(x == 12) or (x == 9)or (x == 14)or (x == 15) or (x == 17) or (x==18)or (x==20)or(x==21) or (x==23)):
    a = rs.MoveObjects(y, translation)
else:
    a = rs.MoveObjects(y, translationo)
# ---------- end python_2 ----------
preview = CustomPreview(Geometry=python_2.a, Material=ColourSwatch(SwatchColor=RGB(230, 236, 98)))  # disabled

# ----
# facade ground level
file_path_3 = FilePath(["C:\Users\sk928\Desktop\thesis\w6_polygonization (1)\w6_polygonization\data\bmc\gl_facade_tile\t_00.obj", "C:\Users\sk928\Desktop\thesis\w6_polygonization (1)\w6_polygonization\data\bmc\gl_facade_tile\t_01.obj", "C:\Users\sk928\Desktop\thesis\w6_polygonization (1)\w6_polygonization\data\bmc\gl_facade_tile\t_02.obj", "C:\Users\sk928\Desktop\thesis\w6_polygonization (1)\w6_polygonization\data\bmc\gl_facade_tile\t_03.obj", "C:\Users\sk928\Desktop\thesis\w6_polygonization (1)\w6_polygonization\data\bmc\gl_facade_tile\t_04.obj", "C:\Users\sk928\Desktop\thesis\w6_polygonization (1)\w6_polygonization\data\bmc\gl_facade_tile\t_05.obj", "C:\Users\sk928\Desktop\thesis\w6_polygonization (1)\w6_polygonization\data\bmc\gl_facade_tile\t_06.obj", "C:\Users\sk928\Desktop\thesis\w6_polygonization (1)\w6_polygonization\data\bmc\gl_facade_tile\t_07.obj", "C:\Users\sk928\Desktop\thesis\w6_polygonization (1)\w6_polygonization\data\bmc\gl_facade_tile\t_08.obj", "C:\Users\sk928\Desktop\thesis\w6_polygonization (1)\w6_polygonization\data\bmc\gl_facade_tile\t_09.obj", "C:\Users\sk928\Desktop\thesis\w6_polygonization (1)\w6_polygonization\data\bmc\gl_facade_tile\t_10.obj", "C:\Users\sk928\Desktop\thesis\w6_polygonization (1)\w6_polygonization\data\bmc\gl_facade_tile\t_11.obj", "C:\Users\sk928\Desktop\thesis\w6_polygonization (1)\w6_polygonization\data\bmc\gl_facade_tile\t_12.obj", "C:\Users\sk928\Desktop\thesis\w6_polygonization (1)\w6_polygonization\data\bmc\gl_facade_tile\t_13.obj", "C:\Users\sk928\Desktop\thesis\w6_polygonization (1)\w6_polygonization\data\bmc\gl_facade_tile\t_14.obj", "C:\Users\sk928\Desktop\thesis\w6_polygonization (1)\w6_polygonization\data\bmc\gl_facade_tile\t_15.obj", "C:\Users\sk928\Desktop\thesis\w6_polygonization (1)\w6_polygonization\data\bmc\gl_facade_tile\t_16.obj", "C:\Users\sk928\Desktop\thesis\w6_polygonization (1)\w6_polygonization\data\bmc\gl_facade_tile\t_17.obj", "C:\Users\sk928\Desktop\thesis\w6_polygonization (1)\w6_polygonization\data\bmc\gl_facade_tile\t_18.obj", "C:\Users\sk928\Desktop\thesis\w6_polygonization (1)\w6_polygonization\data\bmc\gl_facade_tile\t_19.obj", "C:\Users\sk928\Desktop\thesis\w6_polygonization (1)\w6_polygonization\data\bmc\gl_facade_tile\t_20.obj", "C:\Users\sk928\Desktop\thesis\w6_polygonization (1)\w6_polygonization\data\bmc\gl_facade_tile\t_21.obj", "C:\Users\sk928\Desktop\thesis\w6_polygonization (1)\w6_polygonization\data\bmc\gl_facade_tile\t_22.obj", "C:\Users\sk928\Desktop\thesis\w6_polygonization (1)\w6_polygonization\data\bmc\gl_facade_tile\t_23.obj"])
python_script_3 = PythonScript(x=file_path_3)  # -> out, a, b; same code as python_script
panel_6 = Panel(file_path_3)
construct_mesh_3 = ConstructMesh(Vertices=python_script_3.a, Faces=python_script_3.b)  # -> graft(Mesh)
flatten_3 = FlattenTree(Tree=construct_mesh_3, Path="{0}")
item_3 = ListItem(List=simplify(flatten_3), Index=number_slider, Wrap=True)
python_3 = GhPythonScript(x=number_slider, y=item_3)  # -> out, a; same code as python_2
preview_2 = CustomPreview(Geometry=python_3.a, Material=ColourSwatch(SwatchColor=RGB(177, 23, 98)))  # disabled

python_4 = GhPythonScript(x=number_slider, y=item)  # -> out, a
# ---------- python_4: Python ----------
__author__ = "sk928"
__version__ = "2022.01.11"

import rhinoscriptsyntax as rs
import Rhino as rc

x= int(x)
print x
translation = rs.VectorCreate((0,0,0), (0,0,1)) 
translationo = rs.VectorCreate((0,0,0), (0,0,0))

if ((x == 2)or(x == 3) or(x == 6)or(x == 12) or (x == 11)or (x == 8)or (x == 9)or (x == 14) or(x == 15) or (x == 17) or (x==18)or (x==20)or(x==21) or (x==23)):
    a = rs.MoveObjects(y, translation)
else:
    a = rs.MoveObjects(y, translationo)
# ---------- end python_4 ----------
preview_3 = CustomPreview(Geometry=python_4.a, Material=ColourSwatch(SwatchColor=RGB(78, 68, 104)))
path = FilePath(["C:\Users\sk928\Documents\GitHub\Thesis-modular-facade\data\bmc\bmc_newtemplates\e_neighs_00.csv", "C:\Users\sk928\Documents\GitHub\Thesis-modular-facade\data\bmc\bmc_newtemplates\e_neighs_01.csv", "C:\Users\sk928\Documents\GitHub\Thesis-modular-facade\data\bmc\bmc_newtemplates\e_neighs_02.csv", "C:\Users\sk928\Documents\GitHub\Thesis-modular-facade\data\bmc\bmc_newtemplates\e_neighs_03.csv", "C:\Users\sk928\Documents\GitHub\Thesis-modular-facade\data\bmc\bmc_newtemplates\e_neighs_04.csv", "C:\Users\sk928\Documents\GitHub\Thesis-modular-facade\data\bmc\bmc_newtemplates\e_neighs_05.csv", "C:\Users\sk928\Documents\GitHub\Thesis-modular-facade\data\bmc\bmc_newtemplates\e_neighs_06.csv", "C:\Users\sk928\Documents\GitHub\Thesis-modular-facade\data\bmc\bmc_newtemplates\e_neighs_07.csv", "C:\Users\sk928\Documents\GitHub\Thesis-modular-facade\data\bmc\bmc_newtemplates\e_neighs_08.csv", "C:\Users\sk928\Documents\GitHub\Thesis-modular-facade\data\bmc\bmc_newtemplates\e_neighs_09.csv", "C:\Users\sk928\Documents\GitHub\Thesis-modular-facade\data\bmc\bmc_newtemplates\e_neighs_10.csv", "C:\Users\sk928\Documents\GitHub\Thesis-modular-facade\data\bmc\bmc_newtemplates\e_neighs_11.csv", "C:\Users\sk928\Documents\GitHub\Thesis-modular-facade\data\bmc\bmc_newtemplates\e_neighs_12.csv", "C:\Users\sk928\Documents\GitHub\Thesis-modular-facade\data\bmc\bmc_newtemplates\e_neighs_13.csv", "C:\Users\sk928\Documents\GitHub\Thesis-modular-facade\data\bmc\bmc_newtemplates\e_neighs_14.csv", "C:\Users\sk928\Documents\GitHub\Thesis-modular-facade\data\bmc\bmc_newtemplates\e_neighs_15.csv"])
path_2 = FilePath(["C:\Users\sk928\Documents\GitHub\Thesis-modular-facade\data\bmc\bmc_newtemplates\neighs_00.csv", "C:\Users\sk928\Documents\GitHub\Thesis-modular-facade\data\bmc\bmc_newtemplates\neighs_01.csv", "C:\Users\sk928\Documents\GitHub\Thesis-modular-facade\data\bmc\bmc_newtemplates\neighs_02.csv", "C:\Users\sk928\Documents\GitHub\Thesis-modular-facade\data\bmc\bmc_newtemplates\neighs_03.csv", "C:\Users\sk928\Documents\GitHub\Thesis-modular-facade\data\bmc\bmc_newtemplates\neighs_04.csv", "C:\Users\sk928\Documents\GitHub\Thesis-modular-facade\data\bmc\bmc_newtemplates\neighs_05.csv", "C:\Users\sk928\Documents\GitHub\Thesis-modular-facade\data\bmc\bmc_newtemplates\neighs_06.csv", "C:\Users\sk928\Documents\GitHub\Thesis-modular-facade\data\bmc\bmc_newtemplates\neighs_07.csv", "C:\Users\sk928\Documents\GitHub\Thesis-modular-facade\data\bmc\bmc_newtemplates\neighs_08.csv", "C:\Users\sk928\Documents\GitHub\Thesis-modular-facade\data\bmc\bmc_newtemplates\neighs_09.csv", "C:\Users\sk928\Documents\GitHub\Thesis-modular-facade\data\bmc\bmc_newtemplates\neighs_10.csv", "C:\Users\sk928\Documents\GitHub\Thesis-modular-facade\data\bmc\bmc_newtemplates\neighs_11.csv", "C:\Users\sk928\Documents\GitHub\Thesis-modular-facade\data\bmc\bmc_newtemplates\neighs_12.csv", "C:\Users\sk928\Documents\GitHub\Thesis-modular-facade\data\bmc\bmc_newtemplates\neighs_13.csv", "C:\Users\sk928\Documents\GitHub\Thesis-modular-facade\data\bmc\bmc_newtemplates\neighs_14.csv", "C:\Users\sk928\Documents\GitHub\Thesis-modular-facade\data\bmc\bmc_newtemplates\neighs_15.csv"])
path_3 = FilePath(["C:\Users\sk928\Documents\GitHub\Thesis-modular-facade\data\bmc\bmc_newtemplates\core_00.csv", "C:\Users\sk928\Documents\GitHub\Thesis-modular-facade\data\bmc\bmc_newtemplates\core_01.csv", "C:\Users\sk928\Documents\GitHub\Thesis-modular-facade\data\bmc\bmc_newtemplates\core_02.csv", "C:\Users\sk928\Documents\GitHub\Thesis-modular-facade\data\bmc\bmc_newtemplates\core_03.csv", "C:\Users\sk928\Documents\GitHub\Thesis-modular-facade\data\bmc\bmc_newtemplates\core_04.csv", "C:\Users\sk928\Documents\GitHub\Thesis-modular-facade\data\bmc\bmc_newtemplates\core_05.csv", "C:\Users\sk928\Documents\GitHub\Thesis-modular-facade\data\bmc\bmc_newtemplates\core_06.csv", "C:\Users\sk928\Documents\GitHub\Thesis-modular-facade\data\bmc\bmc_newtemplates\core_07.csv", "C:\Users\sk928\Documents\GitHub\Thesis-modular-facade\data\bmc\bmc_newtemplates\core_08.csv", "C:\Users\sk928\Documents\GitHub\Thesis-modular-facade\data\bmc\bmc_newtemplates\core_09.csv", "C:\Users\sk928\Documents\GitHub\Thesis-modular-facade\data\bmc\bmc_newtemplates\core_10.csv", "C:\Users\sk928\Documents\GitHub\Thesis-modular-facade\data\bmc\bmc_newtemplates\core_11.csv", "C:\Users\sk928\Documents\GitHub\Thesis-modular-facade\data\bmc\bmc_newtemplates\core_12.csv", "C:\Users\sk928\Documents\GitHub\Thesis-modular-facade\data\bmc\bmc_newtemplates\core_13.csv", "C:\Users\sk928\Documents\GitHub\Thesis-modular-facade\data\bmc\bmc_newtemplates\core_14.csv", "C:\Users\sk928\Documents\GitHub\Thesis-modular-facade\data\bmc\bmc_newtemplates\core_15.csv"])
number_slider_2 = Slider(0.191, range=0..1)
number_slider_3 = Slider(1, range=0..1)
load_lattice = GhPythonScript(path=path, frame=number_slider)  # -> out, minbound, unit, shape, lattice; inputs path: list, frame: Int32
# ---------- load_lattice: Python ----------
__author__ = "Shervin Azadi"
__license__ = "MIT"
__version__ = "1.0"
__url__ = "https://github.com/shervinazadi/spatial_computing_workshops"
__summary__ = "Loading Lattice CSV"

import Rhino.Geometry as rg
import csv
import ast

def read_csv(path):
    records = []
    minbound,shape,unit = [],[],[]
    with open(path) as csvfile:
        spamreader = csv.reader(csvfile, delimiter=',', quotechar='|')
        for i, row in enumerate(spamreader):
            if 0 < i < 4:
                vals = [ast.literal_eval(item) for item in row]
                minbound.append(vals[0])
                shape.append(vals[1])
                unit.append(vals[2])
            if i > 5:
                records.append([ast.literal_eval(item) for item in row])
    return (records,minbound,shape,unit)
    
# retrieve results
lattice, minbound, shape, unit = read_csv(path[frame])
# ---------- end load_lattice ----------
load_lattice_2 = GhPythonScript(path=path_2, frame=number_slider)  # -> out, minbound, unit, shape, lattice; inputs path: list, frame: Int32; same code as load_lattice
load_lattice_3 = GhPythonScript(path=path_3, frame=number_slider)  # -> out, minbound, unit, shape, lattice; inputs path: list, frame: Int32; same code as load_lattice
lattice_to_points = GhPythonScript(
    minbound=load_lattice_3.minbound,
    unit=load_lattice_3.unit,
    shape=load_lattice_3.shape,
    lattice=load_lattice_3.lattice,
    low_bound=number_slider_2,
    high_bound=number_slider_3)  # -> out, points, values; inputs minbound: list, unit: list, shape: list, lattice: list
# ---------- lattice_to_points: Python ----------
__author__ = "Shervin Azadi"
__license__ = "MIT"
__version__ = "1.0"
__url__ = "https://github.com/shervinazadi/spatial_computing_workshops"
__summary__ = "Visualize Lattice CSV"

import Rhino.Geometry as rg

points = []
values = []
for row in lattice:
    if  low_bound <= row[3] <= high_bound:
        point = rg.Point3d(row[0]*unit[0] + minbound[0], row[1]*unit[1] + minbound[1], row[2]*unit[2] + minbound[2])
        points.append(point)
        values.append(row[3])
# ---------- end lattice_to_points ----------
lattice_to_points_2 = GhPythonScript(
    minbound=load_lattice.minbound,
    unit=load_lattice.unit,
    shape=load_lattice.shape,
    lattice=load_lattice.lattice,
    low_bound=number_slider_2,
    high_bound=number_slider_3)  # -> out, points, values; inputs minbound: list, unit: list, shape: list, lattice: list; same code as lattice_to_points
lattice_to_points_3 = GhPythonScript(
    minbound=load_lattice_2.minbound,
    unit=load_lattice_2.unit,
    shape=load_lattice_2.shape,
    lattice=load_lattice_2.lattice,
    low_bound=number_slider_2,
    high_bound=number_slider_3)  # -> out, points, values; inputs minbound: list, unit: list, shape: list, lattice: list; same code as lattice_to_points
pt_2 = Point(Point(0, 0, -1))
xy = XYPlane(Origin=pt_2)
brep_2 = Brep([<brep referenced from the Rhino model> x3])
box = CenterBox(Base=lattice_to_points.points, X=0.5, Y=0.5, Z=0.5)
lattice_to_points_4 = GhPythonScript(
    minbound=load_lattice_3.minbound,
    unit=load_lattice_3.unit,
    shape=load_lattice_3.shape,
    lattice=load_lattice_3.lattice,
    low_bound=number_slider_2,
    high_bound=number_slider_3)  # -> out, points, values; inputs minbound: list, unit: list, shape: list, lattice: list; same code as lattice_to_points

# ---- group: Split component
python_5 = PythonScript(brp=brep_2, pln=xy)  # -> out, pieces; inputs brp: Brep, pln: list of Plane
# ---------- python_5: Python ----------
import rhinoscriptsyntax as rs
import Rhino as rh
import System as sys
import scriptcontext as sc

""" S
Split Brep plane 2012, 
by Arie-Willem de Jongh
"""


arrBrep =[]
arrBrep.append(brp)

if brp and pln:
    
    bb = rh.Geometry.Brep.GetBoundingBox(brp,rh.Geometry.Plane.WorldXY)
    
    for i in pln:
        bool,extU,extV = rh.Geometry.Plane.ExtendThroughBox(i,bb)
        extU.T0 = extU.T0 - 1
        extU.T1 = extU.T1 + 1
        extV.T0 = extV.T0 - 1
        extV.T1 = extV.T1 + 1
        
        planeSrf = rh.Geometry.PlaneSurface(i,extU,extV)
        splitter = planeSrf.ToBrep()
        arrBrepC = arrBrep[:]
        for j in arrBrepC:
            brep = rs.coercebrep(j)
            tbrep = brep.Split(splitter,0.001)
            if tbrep:
                arrBrep.remove(j)
                for k in tbrep:
                    h=k.CapPlanarHoles(0.001)
                    if h:
                        arrBrep.append(h)
                    else:
                        arrBrep.append(k)

pieces = arrBrep
# ---------- end python_5 ----------

# ----
box_2 = CenterBox(Base=lattice_to_points_3.points, X=0.5, Y=0.5, Z=0.5)
box_3 = CenterBox(Base=lattice_to_points_2.points, X=0.5, Y=0.5, Z=0.5)
debrep = DeconstructBrep(Brep=box)  # -> Faces, Edges, Vertices
pt_3 = Point(Point(-3, 0, 0))
brep_3 = Brep(python_5.pieces)
move_2 = Move(Geometry=python_5.pieces, Motion=pt_3)  # -> Geometry, Transform
panel_7 = Panel(brep_3)
vec_2 = VectorXYZ(XComponent=Slider(-1, range=-10..10), YComponent=Slider(-1, range=-10..10), ZComponent=Slider(-2, range=-10..10))  # -> Vector, Length
move_3 = Move(Geometry=debrep.Faces, Motion=vec_2.Vector)  # -> Geometry, Transform
move_4 = Move(Geometry=box_2, Motion=vec_2.Vector)  # -> Geometry, Transform
move_5 = Move(Geometry=box_3, Motion=vec_2.Vector)  # -> Geometry, Transform
group = Group(Objects=move_4.Geometry)
group_2 = Group(Objects=move_3.Geometry)
group_3 = Group(Objects=move_5.Geometry)
bang = ExplodeTree(Data=graft([group_2, group, group_3]))  # -> _0000, _00000, _0001
swatch = ColourSwatch(SwatchColor=RGBA(187, 93, 101, 42))
preview_4 = CustomPreview(Geometry=bang._0000, Material=ColourSwatch(SwatchColor=RGBA(189, 101, 98, 188)))
preview_5 = CustomPreview(Geometry=bang._00000, Material=ColourSwatch(SwatchColor=RGBA(255, 255, 100, 41)))
preview_6 = CustomPreview(Geometry=bang._0001, Material=ColourSwatch(SwatchColor=RGBA(189, 101, 98, 52)))
