# Grasshopper definition tileset generator.gh (Grasshopper 1.0.7)
# plug-ins: Pufferfish

path = FilePath(["C:\Users\sk928\Downloads\w6_polygonization_Danique\data\bmc\lattice\l_bis_000.csv", "C:\Users\sk928\Downloads\w6_polygonization_Danique\data\bmc\lattice\l_bis_001.csv", "C:\Users\sk928\Downloads\w6_polygonization_Danique\data\bmc\lattice\l_bis_002.csv", "C:\Users\sk928\Downloads\w6_polygonization_Danique\data\bmc\lattice\l_bis_003.csv", "C:\Users\sk928\Downloads\w6_polygonization_Danique\data\bmc\lattice\l_bis_004.csv", "C:\Users\sk928\Downloads\w6_polygonization_Danique\data\bmc\lattice\l_bis_005.csv"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])
load_lattice = GhPythonScript(path=path, frame=Slider(13, range=0..256))  # -> out, minbound, unit, shape, lattice; inputs path: list, frame: Int32
# ---------- load_lattice: Python ----------
__author__ = "Shervin Azadi"
__license__ = "MIT"
__version__ = "1.0"
__url__ = "https://github.com/shervinazadi/spatial_computing_workshops"
__summary__ = "Loading Lattice CSV"

import Rhino.Geometry as rg
import csv
import ast

def read_csv(path):
    records = []
    minbound,shape,unit = [],[],[]
    with open(path) as csvfile:
        spamreader = csv.reader(csvfile, delimiter=',', quotechar='|')
        for i, row in enumerate(spamreader):
            if 0 < i < 4:
                vals = [ast.literal_eval(item) for item in row]
                minbound.append(vals[0])
                shape.append(vals[1])
                unit.append(vals[2])
            if i > 5:
                records.append([ast.literal_eval(item) for item in row])
    return (records,minbound,shape,unit)
    
# retrieve results
lattice, minbound, shape, unit = read_csv(path[frame])
# ---------- end load_lattice ----------
number_slider = Slider(0.5, range=0..1)
lattice_to_points = GhPythonScript(
    minbound=load_lattice.minbound,
    unit=load_lattice.unit,
    shape=load_lattice.shape,
    lattice=load_lattice.lattice,
    low_bound=Slider(0.467, range=0..1),
    high_bound=Slider(1, range=0..1))  # -> out, points, values; inputs minbound: list, unit: list, shape: list, lattice: list
# ---------- lattice_to_points: Python ----------
__author__ = "Shervin Azadi"
__license__ = "MIT"
__version__ = "1.0"
__url__ = "https://github.com/shervinazadi/spatial_computing_workshops"
__summary__ = "Visualize Lattice CSV"

import Rhino.Geometry as rg

points = []
values = []
for row in lattice:
    if  low_bound <= row[3] <= high_bound:
        point = rg.Point3d(row[0]*unit[0] + minbound[0], row[1]*unit[1] + minbound[1], row[2]*unit[2] + minbound[2])
        points.append(point)
        values.append(row[3])
# ---------- end lattice_to_points ----------
vec = VectorXYZ(XComponent=number_slider, YComponent=number_slider, ZComponent=number_slider)  # -> Vector, Length
box = CenterBox(Base=lattice_to_points.points, X=0.5, Y=0.5, Z=0.5)
debrep = DeconstructBrep(Brep=box)  # -> Faces, Edges, Vertices
move = Move(Geometry=debrep.Faces, Motion=vec.Vector)  # -> Geometry, Transform
group = Group(Objects=move.Geometry)
bang = ExplodeTree(Data=flatten(group))  # -> Branch0, Branch1, Branch2
preview = CustomPreview(Geometry=bang.Branch0, Material=ColourSwatch(SwatchColor=RGBA(189, 101, 98, 94)))

# ----
# Set tileset number count
number_slider_2 = Slider(13, range=0..1000)
# Set base brep and center points based on rhino
panel = Panel(" base breps")

panel_2 = Panel("Window tileset 1 ")
brep = Brep([<brep referenced from the Rhino model> x28])
brep_2 = Brep([<brep referenced from the Rhino model> x42])
panel_3 = Panel("window t1 center point")
pt = Point(<point referenced from the Rhino model>)
pt_2 = Point(<point referenced from the Rhino model>)
pt_3 = Point(<point referenced from the Rhino model>)

# ----
# Set directory
panel_4 = Panel("C:\Users\sk928\Documents\GitHub\Thesis-modular-facade\data\bmc\newsaving")

brep_3 = Brep(<brep referenced from the Rhino model>)
brep_4 = Brep(<brep referenced from the Rhino model>)
brep_5 = Brep(<brep referenced from the Rhino model>)
pt_4 = Point(<point referenced from the Rhino model>)

brep_6 = Brep([<brep referenced from the Rhino model> x26])
brep_7 = Brep([<brep referenced from the Rhino model> x23])

list = ValueList({"basic 1": 0, "basic 2": 1, "basic 3": 2, "basic 4": 3}, selected="basic 1")
pt_5 = Point(<point referenced from the Rhino model>)
panel_5 = Panel(" base center points")
series = Series(Start=0, Step="255", Count=number_slider_2)
item = ListItem(List=series, Index=list, Wrap=True)
panel_6 = Panel("CEILING breps")

brep_8 = Brep([<brep referenced from the Rhino model> x4])
brep_9 = Brep([<brep referenced from the Rhino model> x4])
brep_10 = Brep([<brep referenced from the Rhino model> x3])
pt_6 = Point(<point referenced from the Rhino model>)

brep_11 = Brep([<brep referenced from the Rhino model> x4])

panel_7 = Panel("Window tileset 2")
brep_12 = Brep([<brep referenced from the Rhino model> x31])
brep_13 = Brep([<brep referenced from the Rhino model> x23])
panel_8 = Panel("window t2 center point")
pt_7 = Point(<point referenced from the Rhino model>)
pt_8 = Point(<point referenced from the Rhino model>)
pt_9 = Point(<point referenced from the Rhino model>)

brep_14 = Brep([<brep referenced from the Rhino model> x25])
brep_15 = Brep([<brep referenced from the Rhino model> x27])

pt_10 = Point(<point referenced from the Rhino model>)
pt_11 = Point(<point referenced from the Rhino model>)
toggle = BooleanToggle(False)

panel_10 = Panel("Window tileset 3")
brep_16 = Brep([<brep referenced from the Rhino model> x31])
brep_17 = Brep([<brep referenced from the Rhino model> x23])
pt_12 = Point(<point referenced from the Rhino model>)
pt_13 = Point(<point referenced from the Rhino model>)
pt_14 = Point(<point referenced from the Rhino model>)

brep_18 = Brep([<brep referenced from the Rhino model> x24])
brep_19 = Brep([<brep referenced from the Rhino model> x28])

pt_15 = Point(<point referenced from the Rhino model>)
pt_16 = Point(<point referenced from the Rhino model>)
pt_17 = Point(<point referenced from the Rhino model>)
panel_12 = Panel("point for origin")
pt_18 = Point(<point referenced from the Rhino model>)
pt_19 = Point(<point referenced from the Rhino model>)
pt_20 = Point(<point referenced from the Rhino model>)
# Base tileset generate
panel_13 = Panel("""001
016
064
004""")
rotate = Rotate(Geometry=brep_3, Angle=degrees(Slider(90, range=0..100)), Plane=pt_5)  # -> Geometry, Transform
xz = XZPlane(Origin=pt_5)
yz = YZPlane(Origin=pt_5)
toggle_2 = BooleanToggle(False)
panel_14 = Panel("""005
017
080
068""")
move2pt = MoveToPoint(Geometry=brep_9, PointA=pt_6, PointB=pt_20)  # -> Moved, Vector, Transform
move2pt_2 = MoveToPoint(Geometry=brep_11, PointA=pt_11, PointB=pt_18)  # -> Moved, Vector, Transform
mirror = Mirror(Geometry=brep_3, Plane=xz)  # -> Geometry, Transform
mirror_2 = Mirror(Geometry=rotate.Geometry, Plane=yz)  # -> Geometry, Transform
panel_15 = Panel("""021
081
084
069""")
cluster = Cluster_2(A_2=panel_13, bake=toggle, B_2=item, dir=panel_4, G=[mirror_2.Geometry, brep_5, brep_3], A=pt_5, y=pt_15, B=pt_15)
cluster_2 = Cluster_2(A_2=panel_15, bake=toggle, B_2=item, dir=panel_4, G=brep_4, A=pt_4, y=pt_17, B=pt_17)
mjoin = MeshJoin(Meshes=move2pt_2.Moved)
cluster_3 = Cluster_2(A_2=panel_14, bake=toggle, B_2=item, dir=panel_4, G=[mirror.Geometry, brep_3], A=pt_5, y=pt_16, B=pt_16)
cluster_4 = Cluster_3(G_2=[brep_8, brep_10], G=brep_8, P=pt_10, B=pt_19, O=pt_10, A=pt_10)
mjoin_2 = MeshJoin(Meshes=move2pt.Moved)
move2pt_3 = MoveToPoint(Geometry=brep_2, PointA=pt_3, PointB=pt_20)  # -> Moved, Vector, Transform
move2pt_4 = MoveToPoint(Geometry=brep_12, PointA=pt_7, PointB=pt_18)  # -> Moved, Vector, Transform
move2pt_5 = MoveToPoint(Geometry=brep_13, PointA=pt_8, PointB=pt_20)  # -> Moved, Vector, Transform
cluster_5 = Cluster_3(G_2=[brep_7, brep_6], G=brep_6, P=pt_2, B=pt_19, O=pt_2, A=pt_2)
cluster_6 = Cluster_4(G=brep_15, G_2=[brep_14, brep_15], A=pt_9, P=pt_9, B=pt_19, O=pt_9)
move2pt_6 = MoveToPoint(Geometry=brep_16, PointA=pt_12, PointB=pt_18)  # -> Moved, Vector, Transform
move2pt_7 = MoveToPoint(Geometry=brep_17, PointA=pt_13, PointB=pt_20)  # -> Moved, Vector, Transform
cluster_7 = Cluster_3(G_2=brep_19, G=[brep_18, brep_19], P=pt_14, B=pt_19, O=pt_14, A=pt_14)
move2pt_8 = MoveToPoint(Geometry=brep, PointA=pt, PointB=pt_18)  # -> Moved, Vector, Transform
mjoin_3 = MeshJoin(Meshes=move2pt_6.Moved)
mjoin_4 = MeshJoin(Meshes=move2pt_4.Moved)
mjoin_5 = MeshJoin(Meshes=move2pt_8.Moved)
mjoin_6 = MeshJoin(Meshes=move2pt_3.Moved)
mjoin_7 = MeshJoin(Meshes=move2pt_7.Moved)
mjoin_8 = MeshJoin(Meshes=move2pt_5.Moved)
item_2 = ListItem(List=[cluster_5, cluster_6, cluster_7], Index=list, Wrap=True)
item_3 = ListItem(List=[mjoin_5, mjoin_4, mjoin_3], Index=list, Wrap=True)
item_4 = ListItem(List=[mjoin_6, mjoin_8, mjoin_7], Index=list, Wrap=True)
panel_16 = Panel("""042
162
168
138""")
panel_17 = Panel("""002
032
128
008""")
panel_18 = Panel("""010
034
160
136""")
cluster_8 = Cluster_5(A=panel_17, B=item, bake=[toggle_2, toggle], dir=panel_4, x=[item_2, cluster_4], y=pt_19)
cluster_9 = Cluster_5(A=panel_18, B=item, bake=[toggle_2, toggle], dir=panel_4, x=[item_3, mjoin], y=pt_18)
cluster_10 = Cluster_5(A=panel_16, B=item, bake=[toggle_2, toggle], dir=panel_4, x=[item_4, mjoin_2], y=pt_20)
mesh = Mesh(cluster)
mesh_2 = Mesh(cluster_3)
mesh_3 = Mesh(cluster_2)
mesh_4 = Mesh(cluster_8)
mesh_5 = Mesh(cluster_9)
mesh_6 = Mesh(cluster_10)
toggle_3 = BooleanToggle(False)
toggle_4 = BooleanToggle(False)
toggle_5 = BooleanToggle(False)

pt_21 = Point(<point referenced from the Rhino model>)
panel_19 = Panel("""015
051
240
204""")
pt_22 = Point(<point referenced from the Rhino model>)
panel_20 = Panel("""014
035
176
200""")
panel_21 = Panel("""011
050
224
140""")
pt_23 = Point(<point referenced from the Rhino model>)
cluster_11 = Cluster(A_2=panel_19, B_2=item, bake=[toggle_3, toggle], dir=panel_4, G=item_3, A=pt_18, B=pt_22, y=pt_22)
cluster_12 = Cluster(A_2=panel_20, B_2=item, bake=[toggle_3, toggle], dir=panel_4, G=item_3, A=pt_18, B=pt_21, y=pt_21)
cluster_13 = Cluster(A_2=panel_21, B_2=item, bake=[toggle_3, toggle], dir=panel_4, G=item_3, A=pt_18, B=pt_23, y=pt_23)
mesh_7 = Mesh(cluster_12)
mesh_8 = Mesh(cluster_13)
mesh_9 = Mesh(cluster_11)

pt_24 = Point(<point referenced from the Rhino model>)
pt_25 = Point(<point referenced from the Rhino model>)
pt_26 = Point(<point referenced from the Rhino model>)
panel_22 = Panel("""058
226
172
139""")
pt_27 = Point(<point referenced from the Rhino model>)
panel_23 = Panel("""046
163
184
202""")
panel_24 = Panel("""047
179
248
206""")
panel_25 = Panel("""059
242
236
143""")
panel_26 = Panel("""063
243
252
207""")
pt_28 = Point(<point referenced from the Rhino model>)
panel_27 = Panel("""043
178
232
142""")
pt_29 = Point(<point referenced from the Rhino model>)
cluster_14 = Cluster(A_2=panel_27, B_2=item, bake=[toggle_5, toggle], dir=panel_4, G=item_4, A=pt_20, B=pt_29, y=pt_29)
cluster_15 = Cluster(A_2=panel_22, B_2=item, bake=[toggle_5, toggle], dir=panel_4, G=item_4, A=pt_20, B=pt_27, y=pt_27)
cluster_16 = Cluster(A_2=panel_23, B_2=item, bake=[toggle_5, toggle], dir=panel_4, G=item_4, A=pt_20, B=pt_24, y=pt_24)
cluster_17 = Cluster(A_2=panel_24, B_2=item, bake=[toggle_5, toggle], dir=panel_4, G=item_4, A=pt_20, B=pt_25, y=pt_25)
cluster_18 = Cluster(A_2=panel_25, B_2=item, bake=[toggle_5, toggle], dir=panel_4, G=item_4, A=pt_20, B=pt_26, y=pt_26)
cluster_19 = Cluster(A_2=panel_26, B_2=item, bake=[toggle_5, toggle], dir=panel_4, G=item_4, A=pt_20, B=pt_28, y=pt_28)
mesh_10 = Mesh(cluster_14)
mesh_11 = Mesh(cluster_15)
mesh_12 = Mesh(cluster_16)
mesh_13 = Mesh(cluster_17)
mesh_14 = Mesh(cluster_18)
mesh_15 = Mesh(cluster_19)

panel_28 = Panel("""003
048
192
012""")
pt_30 = Point(<point referenced from the Rhino model>)
cluster_20 = Cluster(A_2=panel_28, B_2=item, bake=[toggle_4, toggle], dir=panel_4, G=item_2, A=pt_19, B=pt_30, y=pt_30)
mesh_16 = Mesh(cluster_20)

panel_29 = Panel("""7
049
208
076""")
panel_30 = Panel("""27
114
228
141""")

pt_31 = Point(<point referenced from the Rhino model>)
cluster_21 = Cluster(A_2=panel_30, B_2=item, bake=[toggle_4, toggle], dir=panel_4, G=item_2, A=pt_19, B=pt_31, y=pt_31)
mesh_17 = Mesh(cluster_21)

pt_32 = Point(<point referenced from the Rhino model>)
cluster_22 = Cluster(A_2=panel_29, B_2=item, bake=[toggle_4, toggle], dir=panel_4, G=item_2, A=pt_19, B=pt_32, y=pt_32)
mesh_18 = Mesh(cluster_22)

panel_31 = Panel("""19
112
196
13""")

pt_33 = Point(<point referenced from the Rhino model>)
cluster_23 = Cluster(A_2=panel_31, B_2=item, bake=[toggle_4, toggle], dir=panel_4, G=item_2, A=pt_19, B=pt_33, y=pt_33)
mesh_19 = Mesh(cluster_23)

panel_32 = Panel("""95
117
245
221""")
panel_33 = Panel("""31
115
244
220""")
panel_34 = Panel("""78
39
177
216""")
panel_35 = Panel("""79
55
116
205""")
panel_36 = Panel("""27
114
228
141""")
pt_34 = Point(<point referenced from the Rhino model>)
pt_35 = Point(<point referenced from the Rhino model>)
pt_36 = Point(<point referenced from the Rhino model>)
panel_37 = Panel("""127
247
253
223""")
pt_37 = Point(<point referenced from the Rhino model>)
pt_38 = Point(<point referenced from the Rhino model>)
pt_39 = Point(<point referenced from the Rhino model>)
cluster_24 = Cluster(A_2=panel_34, B_2=item, bake=[toggle_3, toggle], dir=panel_4, G=item_3, A=pt_18, B=pt_38, y=pt_38)
cluster_25 = Cluster(A_2=panel_35, B_2=item, bake=[toggle_3, toggle], dir=panel_4, G=item_3, A=pt_18, B=pt_39, y=pt_39)
cluster_26 = Cluster(A_2=panel_36, B_2=item, bake=[toggle_3, toggle], dir=panel_4, G=item_3, A=pt_18, B=pt_34, y=pt_34)
cluster_27 = Cluster(A_2=panel_33, B_2=item, bake=[toggle_3, toggle], dir=panel_4, G=item_3, A=pt_18, B=pt_35, y=pt_35)
cluster_28 = Cluster(A_2=panel_32, B_2=item, bake=[toggle_3, toggle], dir=panel_4, G=item_3, A=pt_18, B=pt_36, y=pt_36)
cluster_29 = Cluster(A_2=panel_37, B_2=item, bake=[toggle_5, toggle], dir=panel_4, G=item_4, A=pt_20, B=pt_37, y=pt_37)
mesh_20 = Mesh(cluster_24)
mesh_21 = Mesh(cluster_25)
mesh_22 = Mesh(cluster_26)
# bottom 2, top 1 type 2
mesh_23 = Mesh(cluster_27)
mesh_24 = Mesh(cluster_28)
mesh_25 = Mesh(cluster_29)

# ==== cluster Cluster
G = ClusterInput()
A = ClusterInput()
B = ClusterInput()
move2pt = MoveToPoint(Geometry=G, PointA=A, PointB=B)  # -> Moved, Vector, Transform
mjoin = MeshJoin(Meshes=move2pt.Moved)
y = ClusterInput()
python = GhPythonScript(x=mjoin, y=y)  # -> out, b, ypoint
# ---------- python: Python ----------
import os
import rhinoscriptsyntax as rs


vec = rs.VectorCreate((0,0,0),(-2,0,0))

b=[]
ypoint = []
for i in range(4):
    rot = rs.RotateObject(x,y,90*i,None,True)
    mov = rs.MoveObject(rot,vec*(i+1))
    ymov = rs.CopyObject(y,vec*(i+1))
    ypoint.append(ymov)
    b.append(mov)
# ---------- end python ----------
xy = XYPlane(Origin=Point(0, 0, 0))
A_2 = ClusterInput()
B_2 = ClusterInput()
move2pt_2 = MoveToPoint(Geometry=python.b, PointA=python.ypoint, PointB=xy)  # -> Moved, Vector, Transform
b = ClusterOutput(python.b)
addition = Addition(A=A_2, B=B_2)
mesh = Mesh(graft(move2pt_2.Moved))
python_2 = GhPythonScript(x=addition)  # -> out, a
# ---------- python_2: Python ----------
a = "%04d" % (x,)
# ---------- end python_2 ----------
concat = Concatenate(FragmentA="t_", FragmentB=python_2.a, FragmentC=".obj")
graft = GraftTree(Tree=concat, IncludeEmptyLists=True, IncludeNullItems=True)
bake = ClusterInput()
dir = ClusterInput()
save = ObjectSave(
    BakeToggle=bake,
    FileDirectory=dir,
    FileName=graft(graft),
    GeometryObjects=simplify(mesh),
    Layer="GH_Export",
    ObjectName="GH_Obj",
    ObjectColor=RGB(255, 255, 255),
    LayerColor=RGB(255, 255, 255))

# ==== cluster Cluster_2
G = ClusterInput()
A = ClusterInput()
B = ClusterInput()
move2pt = MoveToPoint(Geometry=G, PointA=A, PointB=B)  # -> Moved, Vector, Transform
A_2 = ClusterInput()
B_2 = ClusterInput()
y = ClusterInput()
mjoin = MeshJoin(Meshes=move2pt.Moved)
addition = Addition(A=A_2, B=B_2)
python = GhPythonScript(x=mjoin, y=y)  # -> out, b, ypoint; same code as python
python_2 = GhPythonScript(x=addition)  # -> out, a; same code as python_2
xy = XYPlane(Origin=Point(0, 0, 0))
move2pt_2 = MoveToPoint(Geometry=python.b, PointA=python.ypoint, PointB=xy)  # -> Moved, Vector, Transform
concat = Concatenate(FragmentA="t_", FragmentB=python_2.a, FragmentC=".obj")
b = ClusterOutput(python.b)
graft = GraftTree(Tree=concat, IncludeEmptyLists=True, IncludeNullItems=True)
mesh = Mesh(graft(move2pt_2.Moved))
bake = ClusterInput()
dir = ClusterInput()
save = ObjectSave(
    BakeToggle=[Toggle(False), bake],
    FileDirectory=dir,
    FileName=simplify(graft),
    GeometryObjects=simplify(mesh),
    Layer="GH_Export",
    ObjectName="GH_Obj",
    ObjectColor=RGB(255, 255, 255),
    LayerColor=RGB(255, 255, 255))

# ==== cluster Cluster_3
G = ClusterInput()
P = ClusterInput()
O = ClusterInput()
rotate = Rotate(Geometry=G, Angle=degrees(Slider(90, range=0..100)), Plane=P)  # -> Geometry, Transform
yz = YZPlane(Origin=O)
A = ClusterInput()
mirror = Mirror(Geometry=rotate.Geometry, Plane=yz)  # -> Geometry, Transform
B = ClusterInput()
G_2 = ClusterInput()
move2pt = MoveToPoint(Geometry=[mirror.Geometry, G_2], PointA=A, PointB=B)  # -> Moved, Vector, Transform
mjoin = MeshJoin(Meshes=move2pt.Moved)
M = ClusterOutput(mjoin)

# ==== cluster Cluster_4
G = ClusterInput()
P = ClusterInput()
O = ClusterInput()
rotate = Rotate(Geometry=G, Angle=degrees(Slider(90, range=0..100)), Plane=P)  # -> Geometry, Transform
yz = YZPlane(Origin=O)
G_2 = ClusterInput()
A = ClusterInput()
B = ClusterInput()
mirror = Mirror(Geometry=rotate.Geometry, Plane=yz)  # -> Geometry, Transform
move2pt = MoveToPoint(Geometry=[mirror.Geometry, G_2], PointA=A, PointB=B)  # -> Moved, Vector, Transform
mjoin = MeshJoin(Meshes=move2pt.Moved)
M = ClusterOutput(mjoin)

# ==== cluster Cluster_5
A = ClusterInput()
B = ClusterInput()
x = ClusterInput()
y = ClusterInput()
addition = Addition(A=A, B=B)
python = GhPythonScript(x=x, y=y)  # -> out, b, ypoint; same code as python
python_2 = GhPythonScript(x=addition)  # -> out, a; same code as python_2
xy = XYPlane(Origin=Point(0, 0, 0))
concat = Concatenate(FragmentA="t_", FragmentB=python_2.a, FragmentC=".obj")
move2pt = MoveToPoint(Geometry=python.b, PointA=python.ypoint, PointB=xy)  # -> Moved, Vector, Transform
b = ClusterOutput(python.b)
graft = GraftTree(Tree=concat, IncludeEmptyLists=True, IncludeNullItems=True)  # -> simplify(Tree)
mesh = Mesh(graft(move2pt.Moved))
bake = ClusterInput()
dir = ClusterInput()
save = ObjectSave(
    BakeToggle=[Toggle(False), bake],
    FileDirectory=dir,
    FileName=graft,
    GeometryObjects=simplify(mesh),
    Layer="GH_Export",
    ObjectName="GH_Obj",
    ObjectColor=RGB(255, 255, 255),
    LayerColor=RGB(255, 255, 255))
