# Grasshopper definition tileset_configuring.gh (Grasshopper 1.0.7)
# plug-ins: Pufferfish

# Tileset number
number_slider = Slider(11, range=0..23)

# ----
# structural  tileset
file_path = FilePath(["C:\Users\sk928\Documents\GitHub\Thesis-modular-facade\data\bmc\SUB Tileset\t_00.obj", "C:\Users\sk928\Documents\GitHub\Thesis-modular-facade\data\bmc\SUB Tileset\t_01.obj", "C:\Users\sk928\Documents\GitHub\Thesis-modular-facade\data\bmc\SUB Tileset\t_02.obj", "C:\Users\sk928\Documents\GitHub\Thesis-modular-facade\data\bmc\SUB Tileset\t_03.obj", "C:\Users\sk928\Documents\GitHub\Thesis-modular-facade\data\bmc\SUB Tileset\t_04.obj", "C:\Users\sk928\Documents\GitHub\Thesis-modular-facade\data\bmc\SUB Tileset\t_05.obj", "C:\Users\sk928\Documents\GitHub\Thesis-modular-facade\data\bmc\SUB Tileset\t_06.obj", "C:\Users\sk928\Documents\GitHub\Thesis-modular-facade\data\bmc\SUB Tileset\t_07.obj", "C:\Users\sk928\Documents\GitHub\Thesis-modular-facade\data\bmc\SUB Tileset\t_08.obj", "C:\Users\sk928\Documents\GitHub\Thesis-modular-facade\data\bmc\SUB Tileset\t_09.obj", "C:\Users\sk928\Documents\GitHub\Thesis-modular-facade\data\bmc\SUB Tileset\t_10.obj", "C:\Users\sk928\Documents\GitHub\Thesis-modular-facade\data\bmc\SUB Tileset\t_11.obj", "C:\Users\sk928\Documents\GitHub\Thesis-modular-facade\data\bmc\SUB Tileset\t_12.obj", "C:\Users\sk928\Documents\GitHub\Thesis-modular-facade\data\bmc\SUB Tileset\t_13.obj", "C:\Users\sk928\Documents\GitHub\Thesis-modular-facade\data\bmc\SUB Tileset\t_14.obj", "C:\Users\sk928\Documents\GitHub\Thesis-modular-facade\data\bmc\SUB Tileset\t_15.obj", "C:\Users\sk928\Documents\GitHub\Thesis-modular-facade\data\bmc\SUB Tileset\t_16.obj", "C:\Users\sk928\Documents\GitHub\Thesis-modular-facade\data\bmc\SUB Tileset\t_17.obj", "C:\Users\sk928\Documents\GitHub\Thesis-modular-facade\data\bmc\SUB Tileset\t_18.obj", "C:\Users\sk928\Documents\GitHub\Thesis-modular-facade\data\bmc\SUB Tileset\t_19.obj", "C:\Users\sk928\Documents\GitHub\Thesis-modular-facade\data\bmc\SUB Tileset\t_20.obj", "C:\Users\sk928\Documents\GitHub\Thesis-modular-facade\data\bmc\SUB Tileset\t_21.obj", "C:\Users\sk928\Documents\GitHub\Thesis-modular-facade\data\bmc\SUB Tileset\t_22.obj", "C:\Users\sk928\Documents\GitHub\Thesis-modular-facade\data\bmc\SUB Tileset\t_23.obj"])
python_script = PythonScript(x=file_path)  # -> out, a, b
# ---------- python_script: Python ----------
import Rhino.Geometry as rg
file = open(x)
lines = file.readlines()
pts=[]
faces=[]
for line in lines:
    if line.find("v")==0 and line.find("n")==-1 and line.find("t")==-1:
        print line.split(' ')
        pts.Add(rg.Point3d(float((line.split(' '))[1]),float((line.split(' '))[2]),float((line.split(' '))[3])))
    if line.find("f")==0:
        if line.split(' ').Count==4:
            faces.Add(rg.MeshFace(int(line.split(' ')[1].split('/')[0])-1,int(line.split(' ')[2].split('/')[0])-1,int(line.split(' ')[3].split('/')[0])-1))
        if line.split(' ').Count==5:
            faces.Add(rg.MeshFace(int(line.split(' ')[1].split('/')[0])-1,int(line.split(' ')[2].split('/')[0])-1,int(line.split(' ')[3].split('/')[0])-1,int(line.split(' ')[4].split('/')[0])-1))
a=pts
b=faces
# ---------- end python_script ----------
panel = Panel(file_path)
construct_mesh = ConstructMesh(Vertices=python_script.a, Faces=python_script.b)  # -> graft(Mesh)
flatten = FlattenTree(Tree=construct_mesh, Path="{0}")
item = ListItem(List=simplify(flatten), Index=number_slider, Wrap=True)
python = GhPythonScript(x=number_slider, y=item)  # -> out, a
# ---------- python: Python ----------
__author__ = "sk928"
__version__ = "2022.01.11"

import rhinoscriptsyntax as rs
import Rhino as rc

x= int(x)
print x
translation = rs.VectorCreate((0,0,0), (0,0,1)) 
translationo = rs.VectorCreate((0,0,0), (0,0,0))

if ((x == 3)or(x == 6)or(x == 12) or (x == 9)or (x == 14)or (x == 15) or (x == 17) or (x==18)or (x==20)or(x==21) or (x==23)):
    a = rs.MoveObjects(y, translation)
else:
    a = rs.MoveObjects(y, translationo)
# ---------- end python ----------
preview = CustomPreview(Geometry=python.a, Material=ColourSwatch(SwatchColor=RGB(230, 236, 98)))

# ----
# Facade tileset
file_path_2 = FilePath(["C:\Users\sk928\Documents\GitHub\Thesis-modular-facade\data\bmc\bmc_templates1\core_00.csv", "C:\Users\sk928\Documents\GitHub\Thesis-modular-facade\data\bmc\bmc_templates1\core_01.csv", "C:\Users\sk928\Documents\GitHub\Thesis-modular-facade\data\bmc\bmc_templates1\core_02.csv", "C:\Users\sk928\Documents\GitHub\Thesis-modular-facade\data\bmc\bmc_templates1\core_03.csv", "C:\Users\sk928\Documents\GitHub\Thesis-modular-facade\data\bmc\bmc_templates1\core_04.csv", "C:\Users\sk928\Documents\GitHub\Thesis-modular-facade\data\bmc\bmc_templates1\core_05.csv", "C:\Users\sk928\Documents\GitHub\Thesis-modular-facade\data\bmc\bmc_templates1\core_06.csv", "C:\Users\sk928\Documents\GitHub\Thesis-modular-facade\data\bmc\bmc_templates1\core_07.csv", "C:\Users\sk928\Documents\GitHub\Thesis-modular-facade\data\bmc\bmc_templates1\core_08.csv", "C:\Users\sk928\Documents\GitHub\Thesis-modular-facade\data\bmc\bmc_templates1\core_09.csv", "C:\Users\sk928\Documents\GitHub\Thesis-modular-facade\data\bmc\bmc_templates1\core_10.csv", "C:\Users\sk928\Documents\GitHub\Thesis-modular-facade\data\bmc\bmc_templates1\core_11.csv", "C:\Users\sk928\Documents\GitHub\Thesis-modular-facade\data\bmc\bmc_templates1\core_12.csv", "C:\Users\sk928\Documents\GitHub\Thesis-modular-facade\data\bmc\bmc_templates1\core_13.csv", "C:\Users\sk928\Documents\GitHub\Thesis-modular-facade\data\bmc\bmc_templates1\core_14.csv", "C:\Users\sk928\Documents\GitHub\Thesis-modular-facade\data\bmc\bmc_templates1\core_15.csv", "C:\Users\sk928\Documents\GitHub\Thesis-modular-facade\data\bmc\bmc_templates1\core_16.csv", "C:\Users\sk928\Documents\GitHub\Thesis-modular-facade\data\bmc\bmc_templates1\core_17.csv", "C:\Users\sk928\Documents\GitHub\Thesis-modular-facade\data\bmc\bmc_templates1\core_18.csv", "C:\Users\sk928\Documents\GitHub\Thesis-modular-facade\data\bmc\bmc_templates1\core_19.csv", "C:\Users\sk928\Documents\GitHub\Thesis-modular-facade\data\bmc\bmc_templates1\core_20.csv", "C:\Users\sk928\Documents\GitHub\Thesis-modular-facade\data\bmc\bmc_templates1\core_21.csv", "C:\Users\sk928\Documents\GitHub\Thesis-modular-facade\data\bmc\bmc_templates1\core_22.csv", "C:\Users\sk928\Documents\GitHub\Thesis-modular-facade\data\bmc\bmc_templates1\core_23.csv"])
python_script_2 = PythonScript(x=file_path_2)  # -> out, a, b; same code as python_script
panel_2 = Panel(file_path_2)
construct_mesh_2 = ConstructMesh(Vertices=python_script_2.a, Faces=python_script_2.b)  # -> graft(Mesh)
flatten_2 = FlattenTree(Tree=construct_mesh_2, Path="{0}")
item_2 = ListItem(List=simplify(flatten_2), Index=number_slider, Wrap=True)

# ----
# facade ground level
file_path_3 = FilePath(["C:\Users\sk928\Desktop\thesis\w6_polygonization (1)\w6_polygonization\data\bmc\gl_facade_tile\t_00.obj", "C:\Users\sk928\Desktop\thesis\w6_polygonization (1)\w6_polygonization\data\bmc\gl_facade_tile\t_01.obj", "C:\Users\sk928\Desktop\thesis\w6_polygonization (1)\w6_polygonization\data\bmc\gl_facade_tile\t_02.obj", "C:\Users\sk928\Desktop\thesis\w6_polygonization (1)\w6_polygonization\data\bmc\gl_facade_tile\t_03.obj", "C:\Users\sk928\Desktop\thesis\w6_polygonization (1)\w6_polygonization\data\bmc\gl_facade_tile\t_04.obj", "C:\Users\sk928\Desktop\thesis\w6_polygonization (1)\w6_polygonization\data\bmc\gl_facade_tile\t_05.obj", "C:\Users\sk928\Desktop\thesis\w6_polygonization (1)\w6_polygonization\data\bmc\gl_facade_tile\t_06.obj", "C:\Users\sk928\Desktop\thesis\w6_polygonization (1)\w6_polygonization\data\bmc\gl_facade_tile\t_07.obj", "C:\Users\sk928\Desktop\thesis\w6_polygonization (1)\w6_polygonization\data\bmc\gl_facade_tile\t_08.obj", "C:\Users\sk928\Desktop\thesis\w6_polygonization (1)\w6_polygonization\data\bmc\gl_facade_tile\t_09.obj", "C:\Users\sk928\Desktop\thesis\w6_polygonization (1)\w6_polygonization\data\bmc\gl_facade_tile\t_10.obj", "C:\Users\sk928\Desktop\thesis\w6_polygonization (1)\w6_polygonization\data\bmc\gl_facade_tile\t_11.obj", "C:\Users\sk928\Desktop\thesis\w6_polygonization (1)\w6_polygonization\data\bmc\gl_facade_tile\t_12.obj", "C:\Users\sk928\Desktop\thesis\w6_polygonization (1)\w6_polygonization\data\bmc\gl_facade_tile\t_13.obj", "C:\Users\sk928\Desktop\thesis\w6_polygonization (1)\w6_polygonization\data\bmc\gl_facade_tile\t_14.obj", "C:\Users\sk928\Desktop\thesis\w6_polygonization (1)\w6_polygonization\data\bmc\gl_facade_tile\t_15.obj", "C:\Users\sk928\Desktop\thesis\w6_polygonization (1)\w6_polygonization\data\bmc\gl_facade_tile\t_16.obj", "C:\Users\sk928\Desktop\thesis\w6_polygonization (1)\w6_polygonization\data\bmc\gl_facade_tile\t_17.obj", "C:\Users\sk928\Desktop\thesis\w6_polygonization (1)\w6_polygonization\data\bmc\gl_facade_tile\t_18.obj", "C:\Users\sk928\Desktop\thesis\w6_polygonization (1)\w6_polygonization\data\bmc\gl_facade_tile\t_19.obj", "C:\Users\sk928\Desktop\thesis\w6_polygonization (1)\w6_polygonization\data\bmc\gl_facade_tile\t_20.obj", "C:\Users\sk928\Desktop\thesis\w6_polygonization (1)\w6_polygonization\data\bmc\gl_facade_tile\t_21.obj", "C:\Users\sk928\Desktop\thesis\w6_polygonization (1)\w6_polygonization\data\bmc\gl_facade_tile\t_22.obj", "C:\Users\sk928\Desktop\thesis\w6_polygonization (1)\w6_polygonization\data\bmc\gl_facade_tile\t_23.obj"])
python_script_3 = PythonScript(x=file_path_3)  # -> out, a, b; same code as python_script
panel_3 = Panel(file_path_3)
construct_mesh_3 = ConstructMesh(Vertices=python_script_3.a, Faces=python_script_3.b)  # -> graft(Mesh)
flatten_3 = FlattenTree(Tree=construct_mesh_3, Path="{0}")
item_3 = ListItem(List=simplify(flatten_3), Index=number_slider, Wrap=True)
python_2 = GhPythonScript(x=number_slider, y=item_3)  # -> out, a; same code as python
preview_2 = CustomPreview(Geometry=python_2.a, Material=ColourSwatch(SwatchColor=RGB(177, 23, 98)))

pt = ConstructPoint(XCoordinate="0", YCoordinate=Slider(7, range=0..100), ZCoordinate="0")
X = UnitX(Factor="2")
python_3 = GhPythonScript(x=number_slider, y=item_2)  # -> out, a
# ---------- python_3: Python ----------
__author__ = "sk928"
__version__ = "2022.01.11"

import rhinoscriptsyntax as rs
import Rhino as rc

x= int(x)
print x
translation = rs.VectorCreate((0,0,0), (0,0,1)) 
translationo = rs.VectorCreate((0,0,0), (0,0,0))

if ((x == 3)or(x == 5) or(x == 6)or(x == 12) or (x == 9)or (x == 14)or (x == 15) or (x == 17) or (x==18)or (x==20)or(x==21) or (x==23)):
    a = rs.MoveObjects(y, translation)
else:
    a = rs.MoveObjects(y, translationo)
# ---------- end python_3 ----------
arrlinear = LinearArray(Geometry=pt, Direction=X, Count=Slider(23, range=0..100))  # -> Geometry, Transform
preview_3 = CustomPreview(Geometry=python_3.a, Material=ColourSwatch(SwatchColor=RGBA(0, 0, 0, 112)))
brep = Brep(<brep referenced from the Rhino model>)
path = FilePath(["C:\Users\sk928\Documents\GitHub\Thesis-modular-facade\data\bmc\bmc_templates1\e_neighs_00.csv", "C:\Users\sk928\Documents\GitHub\Thesis-modular-facade\data\bmc\bmc_templates1\e_neighs_01.csv", "C:\Users\sk928\Documents\GitHub\Thesis-modular-facade\data\bmc\bmc_templates1\e_neighs_02.csv", "C:\Users\sk928\Documents\GitHub\Thesis-modular-facade\data\bmc\bmc_templates1\e_neighs_03.csv", "C:\Users\sk928\Documents\GitHub\Thesis-modular-facade\data\bmc\bmc_templates1\e_neighs_04.csv", "C:\Users\sk928\Documents\GitHub\Thesis-modular-facade\data\bmc\bmc_templates1\e_neighs_05.csv", "C:\Users\sk928\Documents\GitHub\Thesis-modular-facade\data\bmc\bmc_templates1\e_neighs_06.csv", "C:\Users\sk928\Documents\GitHub\Thesis-modular-facade\data\bmc\bmc_templates1\e_neighs_07.csv", "C:\Users\sk928\Documents\GitHub\Thesis-modular-facade\data\bmc\bmc_templates1\e_neighs_08.csv", "C:\Users\sk928\Documents\GitHub\Thesis-modular-facade\data\bmc\bmc_templates1\e_neighs_09.csv", "C:\Users\sk928\Documents\GitHub\Thesis-modular-facade\data\bmc\bmc_templates1\e_neighs_10.csv", "C:\Users\sk928\Documents\GitHub\Thesis-modular-facade\data\bmc\bmc_templates1\e_neighs_11.csv", "C:\Users\sk928\Documents\GitHub\Thesis-modular-facade\data\bmc\bmc_templates1\e_neighs_12.csv", "C:\Users\sk928\Documents\GitHub\Thesis-modular-facade\data\bmc\bmc_templates1\e_neighs_13.csv", "C:\Users\sk928\Documents\GitHub\Thesis-modular-facade\data\bmc\bmc_templates1\e_neighs_14.csv", "C:\Users\sk928\Documents\GitHub\Thesis-modular-facade\data\bmc\bmc_templates1\e_neighs_15.csv", "C:\Users\sk928\Documents\GitHub\Thesis-modular-facade\data\bmc\bmc_templates1\e_neighs_16.csv", "C:\Users\sk928\Documents\GitHub\Thesis-modular-facade\data\bmc\bmc_templates1\e_neighs_17.csv", "C:\Users\sk928\Documents\GitHub\Thesis-modular-facade\data\bmc\bmc_templates1\e_neighs_18.csv", "C:\Users\sk928\Documents\GitHub\Thesis-modular-facade\data\bmc\bmc_templates1\e_neighs_19.csv", "C:\Users\sk928\Documents\GitHub\Thesis-modular-facade\data\bmc\bmc_templates1\e_neighs_20.csv", "C:\Users\sk928\Documents\GitHub\Thesis-modular-facade\data\bmc\bmc_templates1\e_neighs_21.csv", "C:\Users\sk928\Documents\GitHub\Thesis-modular-facade\data\bmc\bmc_templates1\e_neighs_22.csv", "C:\Users\sk928\Documents\GitHub\Thesis-modular-facade\data\bmc\bmc_templates1\e_neighs_23.csv"])
path_2 = FilePath(["C:\Users\sk928\Documents\GitHub\Thesis-modular-facade\data\bmc\bmc_templates1\neighs_00.csv", "C:\Users\sk928\Documents\GitHub\Thesis-modular-facade\data\bmc\bmc_templates1\neighs_01.csv", "C:\Users\sk928\Documents\GitHub\Thesis-modular-facade\data\bmc\bmc_templates1\neighs_02.csv", "C:\Users\sk928\Documents\GitHub\Thesis-modular-facade\data\bmc\bmc_templates1\neighs_03.csv", "C:\Users\sk928\Documents\GitHub\Thesis-modular-facade\data\bmc\bmc_templates1\neighs_04.csv", "C:\Users\sk928\Documents\GitHub\Thesis-modular-facade\data\bmc\bmc_templates1\neighs_05.csv", "C:\Users\sk928\Documents\GitHub\Thesis-modular-facade\data\bmc\bmc_templates1\neighs_06.csv", "C:\Users\sk928\Documents\GitHub\Thesis-modular-facade\data\bmc\bmc_templates1\neighs_07.csv", "C:\Users\sk928\Documents\GitHub\Thesis-modular-facade\data\bmc\bmc_templates1\neighs_08.csv", "C:\Users\sk928\Documents\GitHub\Thesis-modular-facade\data\bmc\bmc_templates1\neighs_09.csv", "C:\Users\sk928\Documents\GitHub\Thesis-modular-facade\data\bmc\bmc_templates1\neighs_10.csv", "C:\Users\sk928\Documents\GitHub\Thesis-modular-facade\data\bmc\bmc_templates1\neighs_11.csv", "C:\Users\sk928\Documents\GitHub\Thesis-modular-facade\data\bmc\bmc_templates1\neighs_12.csv", "C:\Users\sk928\Documents\GitHub\Thesis-modular-facade\data\bmc\bmc_templates1\neighs_13.csv", "C:\Users\sk928\Documents\GitHub\Thesis-modular-facade\data\bmc\bmc_templates1\neighs_14.csv", "C:\Users\sk928\Documents\GitHub\Thesis-modular-facade\data\bmc\bmc_templates1\neighs_15.csv", "C:\Users\sk928\Documents\GitHub\Thesis-modular-facade\data\bmc\bmc_templates1\neighs_16.csv", "C:\Users\sk928\Documents\GitHub\Thesis-modular-facade\data\bmc\bmc_templates1\neighs_17.csv", "C:\Users\sk928\Documents\GitHub\Thesis-modular-facade\data\bmc\bmc_templates1\neighs_18.csv", "C:\Users\sk928\Documents\GitHub\Thesis-modular-facade\data\bmc\bmc_templates1\neighs_19.csv", "C:\Users\sk928\Documents\GitHub\Thesis-modular-facade\data\bmc\bmc_templates1\neighs_20.csv", "C:\Users\sk928\Documents\GitHub\Thesis-modular-facade\data\bmc\bmc_templates1\neighs_21.csv", "C:\Users\sk928\Documents\GitHub\Thesis-modular-facade\data\bmc\bmc_templates1\neighs_22.csv", "C:\Users\sk928\Documents\GitHub\Thesis-modular-facade\data\bmc\bmc_templates1\neighs_23.csv"])
path_3 = FilePath(["C:\Users\sk928\Documents\GitHub\Thesis-modular-facade\data\bmc\bmc_templates1\core_00.csv", "C:\Users\sk928\Documents\GitHub\Thesis-modular-facade\data\bmc\bmc_templates1\core_01.csv", "C:\Users\sk928\Documents\GitHub\Thesis-modular-facade\data\bmc\bmc_templates1\core_02.csv", "C:\Users\sk928\Documents\GitHub\Thesis-modular-facade\data\bmc\bmc_templates1\core_03.csv", "C:\Users\sk928\Documents\GitHub\Thesis-modular-facade\data\bmc\bmc_templates1\core_04.csv", "C:\Users\sk928\Documents\GitHub\Thesis-modular-facade\data\bmc\bmc_templates1\core_05.csv", "C:\Users\sk928\Documents\GitHub\Thesis-modular-facade\data\bmc\bmc_templates1\core_06.csv", "C:\Users\sk928\Documents\GitHub\Thesis-modular-facade\data\bmc\bmc_templates1\core_07.csv", "C:\Users\sk928\Documents\GitHub\Thesis-modular-facade\data\bmc\bmc_templates1\core_08.csv", "C:\Users\sk928\Documents\GitHub\Thesis-modular-facade\data\bmc\bmc_templates1\core_09.csv", "C:\Users\sk928\Documents\GitHub\Thesis-modular-facade\data\bmc\bmc_templates1\core_10.csv", "C:\Users\sk928\Documents\GitHub\Thesis-modular-facade\data\bmc\bmc_templates1\core_11.csv", "C:\Users\sk928\Documents\GitHub\Thesis-modular-facade\data\bmc\bmc_templates1\core_12.csv", "C:\Users\sk928\Documents\GitHub\Thesis-modular-facade\data\bmc\bmc_templates1\core_13.csv", "C:\Users\sk928\Documents\GitHub\Thesis-modular-facade\data\bmc\bmc_templates1\core_14.csv", "C:\Users\sk928\Documents\GitHub\Thesis-modular-facade\data\bmc\bmc_templates1\core_15.csv", "C:\Users\sk928\Documents\GitHub\Thesis-modular-facade\data\bmc\bmc_templates1\core_16.csv", "C:\Users\sk928\Documents\GitHub\Thesis-modular-facade\data\bmc\bmc_templates1\core_17.csv", "C:\Users\sk928\Documents\GitHub\Thesis-modular-facade\data\bmc\bmc_templates1\core_18.csv", "C:\Users\sk928\Documents\GitHub\Thesis-modular-facade\data\bmc\bmc_templates1\core_19.csv", "C:\Users\sk928\Documents\GitHub\Thesis-modular-facade\data\bmc\bmc_templates1\core_20.csv", "C:\Users\sk928\Documents\GitHub\Thesis-modular-facade\data\bmc\bmc_templates1\core_21.csv", "C:\Users\sk928\Documents\GitHub\Thesis-modular-facade\data\bmc\bmc_templates1\core_22.csv", "C:\Users\sk928\Documents\GitHub\Thesis-modular-facade\data\bmc\bmc_templates1\core_23.csv"])
brep_2 = Brep([<brep referenced from the Rhino model> x2])
load_lattice = GhPythonScript(path=path_3, frame=number_slider)  # -> out, minbound, unit, shape, lattice; inputs path: list, frame: Int32
# ---------- load_lattice: Python ----------
__author__ = "Shervin Azadi"
__license__ = "MIT"
__version__ = "1.0"
__url__ = "https://github.com/shervinazadi/spatial_computing_workshops"
__summary__ = "Loading Lattice CSV"

import Rhino.Geometry as rg
import csv
import ast

def read_csv(path):
    records = []
    minbound,shape,unit = [],[],[]
    with open(path) as csvfile:
        spamreader = csv.reader(csvfile, delimiter=',', quotechar='|')
        for i, row in enumerate(spamreader):
            if 0 < i < 4:
                vals = [ast.literal_eval(item) for item in row]
                minbound.append(vals[0])
                shape.append(vals[1])
                unit.append(vals[2])
            if i > 5:
                records.append([ast.literal_eval(item) for item in row])
    return (records,minbound,shape,unit)
    
# retrieve results
lattice, minbound, shape, unit = read_csv(path[frame])
# ---------- end load_lattice ----------
number_slider_2 = Slider(0.191, range=0..1)
number_slider_3 = Slider(1, range=0..1)
load_lattice_2 = GhPythonScript(path=path, frame=number_slider)  # -> out, minbound, unit, shape, lattice; inputs path: list, frame: Int32; same code as load_lattice
load_lattice_3 = GhPythonScript(path=path_2, frame=number_slider)  # -> out, minbound, unit, shape, lattice; inputs path: list, frame: Int32; same code as load_lattice
load_lattice_4 = GhPythonScript(path=path_3, frame=number_slider)  # -> out, minbound, unit, shape, lattice; inputs path: list, frame: Int32; same code as load_lattice
pt_2 = Point(<point referenced from the Rhino model>)
yz = YZPlane(Origin=pt_2)
rotate = Rotate(Geometry=brep, Angle=degrees(Slider(90, range=0..100)), Plane=pt_2)  # -> Geometry, Transform
xz = XZPlane(Origin=pt_2)
lattice_to_points = GhPythonScript(
    minbound=load_lattice_2.minbound,
    unit=load_lattice_2.unit,
    shape=load_lattice_2.shape,
    lattice=load_lattice_2.lattice,
    low_bound=number_slider_2,
    high_bound=number_slider_3)  # -> out, points, values; inputs minbound: list, unit: list, shape: list, lattice: list
# ---------- lattice_to_points: Python ----------
__author__ = "Shervin Azadi"
__license__ = "MIT"
__version__ = "1.0"
__url__ = "https://github.com/shervinazadi/spatial_computing_workshops"
__summary__ = "Visualize Lattice CSV"

import Rhino.Geometry as rg

points = []
values = []
for row in lattice:
    if  low_bound <= row[3] <= high_bound:
        point = rg.Point3d(row[0]*unit[0] + minbound[0], row[1]*unit[1] + minbound[1], row[2]*unit[2] + minbound[2])
        points.append(point)
        values.append(row[3])
# ---------- end lattice_to_points ----------
lattice_to_points_2 = GhPythonScript(
    minbound=load_lattice_4.minbound,
    unit=load_lattice_4.unit,
    shape=load_lattice_4.shape,
    lattice=load_lattice_4.lattice,
    low_bound=number_slider_2,
    high_bound=number_slider_3)  # -> out, points, values; inputs minbound: list, unit: list, shape: list, lattice: list; same code as lattice_to_points
lattice_to_points_3 = GhPythonScript(
    minbound=load_lattice_3.minbound,
    unit=load_lattice_3.unit,
    shape=load_lattice_3.shape,
    lattice=load_lattice_3.lattice,
    low_bound=number_slider_2,
    high_bound=number_slider_3)  # -> out, points, values; inputs minbound: list, unit: list, shape: list, lattice: list; same code as lattice_to_points
mirror = Mirror(Geometry=rotate.Geometry, Plane=yz)  # -> Geometry, Transform
mirror_2 = Mirror(Geometry=brep, Plane=xz)  # -> Geometry, Transform
pt_3 = Point(<point referenced from the Rhino model>)
pt_4 = Point(<point referenced from the Rhino model>)
box = CenterBox(Base=lattice_to_points_2.points, X=0.5, Y=0.5, Z=0.5)
move2pt = MoveToPoint(Geometry=[mirror.Geometry, brep_2], PointA=pt_2, PointB=pt_3)  # -> Moved, Vector, Transform
move2pt_2 = MoveToPoint(Geometry=[mirror_2.Geometry, brep], PointA=pt_2, PointB=pt_4)  # -> Moved, Vector, Transform
box_2 = CenterBox(Base=lattice_to_points_3.points, X=0.5, Y=0.5, Z=0.5)
box_3 = CenterBox(Base=lattice_to_points.points, X=0.5, Y=0.5, Z=0.5)
debrep = DeconstructBrep(Brep=box)  # -> Faces, Edges, Vertices
vec = VectorXYZ(XComponent=Slider(-1, range=-10..10), YComponent=Slider(-1, range=-10..10), ZComponent=Slider(-2, range=-10..10))  # -> Vector, Length
move = Move(Geometry=box_3, Motion=vec.Vector)  # -> Geometry, Transform
move_2 = Move(Geometry=debrep.Faces, Motion=vec.Vector)  # -> Geometry, Transform
move_3 = Move(Geometry=box_2, Motion=vec.Vector)  # -> Geometry, Transform
group = Group(Objects=move_3.Geometry)
group_2 = Group(Objects=move_2.Geometry)
group_3 = Group(Objects=move.Geometry)
bang = ExplodeTree(Data=graft([group_2, group, group_3]))  # -> _0000, _00000, _0001
swatch = ColourSwatch(SwatchColor=RGBA(42, 127, 98, 145))
preview_4 = CustomPreview(Geometry=bang._0001, Material=ColourSwatch(SwatchColor=RGBA(153, 255, 204, 144)))
preview_5 = CustomPreview(Geometry=bang._00000, Material=ColourSwatch(SwatchColor=RGBA(214, 164, 100, 73)))
preview_6 = CustomPreview(Geometry=bang._0000, Material=ColourSwatch(SwatchColor=RGBA(201, 112, 100, 79)))
